# Grasshopper definition compas_02.gh (Grasshopper 1.0.7)

path = FilePath("C:\Users\User\Documents\GitHub\COMPAS-II-FS2023\lecture_03\201_visualize_model_artist.py")
path_2 = FilePath("C:\Users\User\Documents\GitHub\COMPAS-II-FS2023\lecture_03\202_visualize_model_with_meshes_artist.py")  # disabled
file = ReadFile(File=path_2, PerLineParse=False)  # disabled
python = GhPythonScript(x=Slider(0, range=0..10), y=Slider(0, range=0..10), z=Slider(4.6, range=0..10))  # -> out, a
# ---------- python: Python ----------
from compas.artists import Artist
from compas.datastructures import Mesh
from compas.geometry import Circle
from compas.geometry import Cylinder
from compas.geometry import Frame
from compas.geometry import Plane
from compas.geometry import Translation
from compas.robots import Configuration
from compas.robots import Joint
from compas.robots import RobotModel

# create cylinder in yz plane
radius, length = 0.3, 5
cylinder = Cylinder(Circle(Plane([0, 0, 0], [1, 0, 0]), radius), length)
cylinder.transform(Translation.from_vector([length / 2.0, 0, 0]))

# create robot model
model = RobotModel("robot", links=[], joints=[])

# link meshes (calling Mesh.from_shape effectively creates a copy of the shape)
mesh1 = Mesh.from_shape(cylinder)
mesh2 = Mesh.from_shape(cylinder)
mesh3 = Mesh.from_shape(cylinder)

# add links
link0 = model.add_link("world")
link1 = model.add_link("link1", visual_mesh=mesh1, visual_color=(0.2, 0.5, 0.6))
link2 = model.add_link("link2", visual_mesh=mesh2, visual_color=(0.5, 0.6, 0.2))
link3 = model.add_link("link3", visual_mesh=mesh3, visual_color=(0.7, 0.7, 0.6))

# add joints between the links
axis = (0, 0, 1)
axis1 = (0, 1, 0)

origin = Frame.worldXY()
model.add_joint("joint1", Joint.CONTINUOUS, link0, link1, origin, axis)

origin = Frame((length, 0, 0), (1, 0, 0), (0, 1, 0))
model.add_joint("joint2", Joint.CONTINUOUS, link1, link2, origin, axis)

origin = Frame((length, 0, 0), (1, 0, 0), (0, 1, 0))
model.add_joint("joint3", Joint.CONTINUOUS, link2, link3, origin, axis1)

# Create a configuration object matching the number of joints in your model
configuration = model.zero_configuration()
configuration.joint_values = [x, y, z]

# Update the model using the artist
artist = Artist(model)
artist.update(configuration)

# Render everything
artist.draw_visual()
artist.redraw()
a = artist.draw_visual()
# ---------- end python ----------
python_2 = GhPythonScript(Code=file)  # -> Out, A; disabled
panel = Panel(python_2.A)  # disabled
draw = Draw(cg=python_2.A)  # -> rg; disabled
#   port cg: The COMPAS geometry or datastructure to be drawn.
#   port rg: The Rhino geometry object.
# ---------- draw: Python ----------
"""
Draws COMPAS geometry in Grasshopper.
"""
from ghpythonlib.componentbase import executingcomponent as component

from compas.artists import Artist


class CompasToRhinoGeometry(component):
    def RunScript(self, cg):
        if not cg:
            return None

        return Artist(cg).draw()
# ---------- end draw ----------
