# Grasshopper definition demo.ghx (Grasshopper 1.0.7)

x = Slider(1, range=0..1)
y = Slider(2, range=0..2)
z = Slider(-10, range=-10..0)
add_paths_from_local_dir = GhPythonScript(file_name="assignment_02.py")  # -> File
# ---------- add_paths_from_local_dir: Python ----------
import os
import sys

#get current file path
path = ghenv.Component.OnPingDocument().FilePath
#get parent directory of the parent directory
parentdir = os.path.dirname(path)
#get src folder which contains classes

File = parentdir + '\\' + file_name
# ---------- end add_paths_from_local_dir ----------
read_file = ReadFile(File=add_paths_from_local_dir, PerLineParse=False)
number = Number(expr("Pi*2*x", x))
ghpython_script = GhPythonScript(Code=read_file, X=number, Y=y, Z=z)  # -> Out, OutTemp
panel = Panel(ghpython_script.OutTemp)
