# Grasshopper definition assignment_03.ghx (Grasshopper 1.0.7)

# ----
# Define one pick-up plane in any way you like,
# for example, reference a point from Rhino and assign a plane to it.
# 
# Make sure the plane is oriented in a way that makes sense
# for the robot to reach it. You can check this by observing the
# results of the IK solution for this pickup-plane.
# 2) Define pick-up plane
pt = Point(Point(0.2051686774, 0.0003611846565, 0.629317878))
yz = YZPlane(Origin=pt)
pickup_plane = Data(yz)

# ----
# Load the robot from ROS.
# 
# Make sure ROS/MoveIt is running before you start (ie. "Compose up").
# 1) Load robot from ROS
toggle = BooleanToggle(True)
ros = ROSConnect(connect=toggle)  # -> ros_client, is_connected; inputs port: Int32, connect: Boolean
#   port ip: The ip address ROS. Defaults to 127.0.0.1.
#   port port: The port of ROS. Defaults to 9090.
#   port connect: If True, connects to ROS. If False, disconnects from ROS. Defaults to False.
#   port ros_client: The ROS client.
#   port is_connected: True if connection established.
# ---------- ros: Python ----------
"""
Connect or disconnect to ROS.

COMPAS FAB v0.22.0
"""
from ghpythonlib.componentbase import executingcomponent as component
from scriptcontext import sticky as st

from compas_fab.backends import RosClient
from compas_fab.ghpython.components import create_id


class ROSConnect(component):
    def RunScript(self, ip, port, connect):
        ros_client = None

        ip = ip or '127.0.0.1'
        port = port or 9090

        key = create_id(self, 'ros_client')
        ros_client = st.get(key, None)

        if ros_client:
            st[key].close()
        if connect:
            st[key] = RosClient(ip, port)
            st[key].run(5)

        ros_client = st.get(key, None)
        is_connected = ros_client.is_connected if ros_client else False
        return (ros_client, is_connected)
# ---------- end ros ----------
robot = ROSRobot(ros_client=ros.ros_client, load=Toggle(True))  # -> robot; inputs load: Boolean
#   port ros_client: The ROS client.
#   port load: If True, loads the robot from ROS. Defaults to False.
# ---------- robot: Python ----------
"""
Load robot directly from ROS.

COMPAS FAB v0.22.0
"""
from compas_ghpython.artists import RobotModelArtist
from ghpythonlib.componentbase import executingcomponent as component
from scriptcontext import sticky as st

from compas_fab.ghpython.components import create_id


class ROSRobot(component):
    def RunScript(self, ros_client, load):
        key = create_id(self, 'robot')

        if ros_client and ros_client.is_connected and load:
            # Load URDF from ROS
            st[key] = ros_client.load_robot(load_geometry=True, precision='12f')
            st[key].artist = RobotModelArtist(st[key].model)

        robot = st.get(key, None)
        if robot:  # client sometimes need to be restarted, without needing to reload geometry
            robot.client = ros_client
        return robot
# ---------- end robot ----------
robot_2 = Data(robot)

# ----
# 4) Solve IK for pick-up plane
# Results in pickup config
pickup_plane_2 = Data(pickup_plane)
zero_config = ZeroConfig()  # -> config
#   port group: If assigned, it will return the zero configuration for the given group, otherwise a full zero configuration.
#   port config: The zero configuration.
# ---------- zero_config: Python ----------
"""
Get a zero configuration for a robot.

COMPAS FAB v0.27.0
"""
from ghpythonlib.componentbase import executingcomponent as component


class ConfigZero(component):
    def RunScript(self, robot, group):

        if robot:
            return robot.zero_configuration(group)

        return None
# ---------- end zero_config ----------
robot_3 = Data(robot_2)
ik = InverseKinematics(robot=robot_3, plane=pickup_plane_2, start_configuration=zero_config)  # -> configuration
#   port plane: The plane or frame to calculate the inverse kinematic for.
#   port start_configuration: If passed, calculates the inverse such that the joint positions differ the least from the start_configuration. Defaults to the zero configuration.
#   port group: The planning group used for calculation. Defaults to the robot's main planning group.
#   port configuration: The planning group's configuration.
# ---------- ik: Python ----------
"""
Calculate the robot's inverse kinematic for a given plane.

COMPAS FAB v0.27.0
"""
from compas_rhino.conversions import RhinoPlane
from ghpythonlib.componentbase import executingcomponent as component


class InverseKinematics(component):
    def RunScript(self, robot, plane, start_configuration, group):
        configuration = None
        if robot and robot.client and robot.client.is_connected and plane:
            frame = RhinoPlane.from_geometry(plane).to_compas_frame()
            configuration = robot.inverse_kinematics(frame, start_configuration, group)
        return configuration
# ---------- end ik ----------
pickup_config = Data(ik)

# ----
# 3) Define target planes
# Use inverse kinematics of the robot to find
# a feasible configuration to reach the pickup plane.
# 
# You can use the COMPAS FAB component or
# code it in a GHPython component.
number_slider = Slider(0.6, range=0..1)
# Define multiple target planes in any way you like, for example,
# reference a curve from Rhino, divide it and assign a plane to each point
# 
# Make sure all planes are oriented in a way that makes sense
# for the robot to reach it as well.
number_slider_2 = Slider(0.2, range=0..1)

# ---- group: curve
python = GhPythonScript(scale=number_slider_2, translation=number_slider)  # -> out, a
# ---------- python: Python ----------
import Rhino.Geometry as rg
import math

# Set parameters for the trefoil knot
a = 3.0
b = 1.0
c = 2.0

# Create a list to store the points of the trefoil knot
points = []

# Define a function to calculate the position of a point on the trefoil knot
def trefoil(t):
    x = scale * (a + b * math.cos(c * t)) * math.cos(t)
    y = scale * (a + b * math.cos(c * t)) * math.sin(t)
    z = scale * b * math.sin(c * t)
    return rg.Point3d(x, y, z)

# Calculate points on the trefoil knot and add them to the list
t = 0
step = 2* math.pi/100
for t in range(100):
    k = step*t
    points.append(trefoil(k))

# Create a polyline curve from the list of points
points.append(points[0])
curve = rg.PolylineCurve(points)

# Move higher
vec = translation * rg.Vector3d.ZAxis
trans = rg.Transform.Translation(vec)
curve.Transform(trans)

# Output the curve to the Grasshopper canvas
a = curve
# ---------- end python ----------

# ----
divide = DivideCurve(Curve=python.a, Count=Slider(10, range=0..10), Kinks=False)  # -> Points, Tangents, Parameters
pdecon = Deconstruct(Point=divide.Points)  # -> XComponent, YComponent, ZComponent
points = PointList(Points=divide.Points, Size=Slider(0.1, range=0..0.1))
pt_2 = ConstructPoint(XCoordinate=0, YCoordinate=0, ZCoordinate=pdecon.ZComponent)
vec2pt = Vector2Pt(PointA=pt_2, PointB=divide.Points, Unitize=False)  # -> Vector, Length
yz_2 = YZPlane(Origin=divide.Points)
padjust = AdjustPlane(Plane=yz_2, Normal=vec2pt.Vector)
target_planes = Data(padjust)

# ----
# 5) Plan trajectory to selected plane
# From pickup config to target plane
number_slider_3 = Slider(0, range=0..10)
target_planes_2 = Data(target_planes)
pickup_config_2 = Data(pickup_config)
# With the pickup config and a list of target planes, you are ready to compute the solution trajectory for each plane.
# 
# First create a constraint from the selected plane, then use the plan free-space motion to calculate a trajectory.
robot_4 = Data(robot_2)
item = ListItem(List=target_planes_2, Index=number_slider_3, Wrap=True)
constraints_from_plane = ConstraintsFromPlane(robot=robot_4, plane=item)  # -> constraints
#   port plane: The plane or frame from which we create position and orientation constraints.
#   port group: The planning group for which we specify the constraint. Defaults to the robot's main planning group.
#   port tolerance_position: The allowed tolerance to the frame's position (defined in the robot's units). Defaults to 0.001
#   port tolerance_xaxis: The allowed tolerance of the frame's X-axis in degrees.
#   port tolerance_yaxis: The allowed tolerance of the frame's Y-axis in degrees.
#   port tolerance_zaxis: The allowed tolerance of the frame's Z-axis in degrees.
#   port constraints: A list containing a position and an orientation constraint.
# ---------- constraints_from_plane: Python ----------
"""
Create a position and an orientation constraint from a plane calculated for the group's end-effector link.

COMPAS FAB v0.27.0
"""
import math

from compas_rhino.conversions import RhinoPlane
from ghpythonlib.componentbase import executingcomponent as component


class ConstraintsFromPlane(component):
    def RunScript(self, robot, plane, group, tolerance_position, tolerance_xaxis, tolerance_yaxis, tolerance_zaxis):
        goal_constraints = None
        if robot and plane:
            tolerance_position = tolerance_position or 0.001
            tolerance_xaxis = tolerance_xaxis or 1.
            tolerance_yaxis = tolerance_yaxis or 1.
            tolerance_zaxis = tolerance_zaxis or 1.

            frame = RhinoPlane.from_geometry(plane).to_compas_frame()
            tolerances_axes = [math.radians(tolerance_xaxis), math.radians(tolerance_yaxis), math.radians(tolerance_zaxis)]
            goal_constraints = robot.constraints_from_frame(frame, tolerance_position, tolerances_axes, group)

        return goal_constraints
# ---------- end constraints_from_plane ----------
plan_motion = PlanMotion(robot=robot_4, goal_constraints=constraints_from_plane, start_configuration=pickup_config_2, compute=Toggle(True))  # -> trajectory; inputs goal_constraints: list, attached_collision_meshes: list, path_constraints: list, compute: Boolean
#   port goal_constraints: The goal to be achieved, defined in a set of constraints. Constraints can be very specific, for example defining value domains for each joint, such that the goal configuration is included, or defining a volume in space, to which a specific robot link (e.g. the end-effector) is required to move to.
#   port start_configuration: The robot's full configuration, i.e. values for all configurable joints of the entire robot, at the starting position. Defaults to the all-zero configuration.
#   port group: The planning group used for calculation. Defaults to the robot's main planning group.
#   port attached_collision_meshes: A list of attached collision meshes to be included for planning.
#   port path_constraints: Optional constraints that can be imposed along the solution path. Note that path calculation won't work if the start_configuration violates these constraints. Defaults to None.
#   port planner_id: The name of the algorithm used for path planning. Defaults to 'RRTConnect'
#   port compute: If True, calculates a trajectory.
#   port trajectory: The calculated trajectory.
# ---------- plan_motion: Python ----------
"""
Calculate a motion path.

COMPAS FAB v0.27.0
"""
from ghpythonlib.componentbase import executingcomponent as component
from scriptcontext import sticky as st

from compas_fab.ghpython.components import create_id


class PlanMotion(component):
    def RunScript(self, robot, goal_constraints, start_configuration, group, attached_collision_meshes, path_constraints, planner_id, compute):

        key = create_id(self, 'trajectory')

        path_constraints = list(path_constraints) if path_constraints else None
        attached_collision_meshes = list(attached_collision_meshes) if attached_collision_meshes else None
        planner_id = str(planner_id) if planner_id else 'RRTConnect'

        if robot and robot.client and robot.client.is_connected and start_configuration and goal_constraints and compute:
            st[key] = robot.plan_motion(goal_constraints,
                                        start_configuration=start_configuration,
                                        group=group,
                                        options=dict(
                                            attached_collision_meshes=attached_collision_meshes,
                                            path_constraints=path_constraints,
                                            planner_id=planner_id,
                                        ))

        trajectory = st.get(key, None)
        return trajectory
# ---------- end plan_motion ----------
trajectory = Data(plan_motion)

# ----
# Visualization
trajectory_2 = Data(trajectory)
pickup_config_3 = Data(pickup_config)
list = ValueList({"Pickup config": 0, "Trajectory": 1}, selected="Trajectory")
robot_5 = Data(robot_2)
get_configs = GhPythonScript(trajectory=trajectory_2)  # -> configs
# ---------- get_configs: Python ----------
configs = trajectory.points
# ---------- end get_configs ----------
filter = StreamFilter(Gate=list, Stream0=pickup_config_3, Stream1=get_configs)
item_2 = ListItem(List=filter, Index=Slider(37, range=0..100), Wrap=True)
robot_visualize = RobotVisualize(robot=robot_5, configuration=item_2)  # -> visual, collision, collision_meshes, attached_meshes, frames, base_frame, ee_frame; inputs show_visual: Boolean, show_collision: Boolean, show_frames: Boolean, show_base_frame: Boolean, show_end_effector_frame: Boolean, show_cm: Boolean, show_acm: Boolean
#   port group: The planning group used for end-effector and base visualization.
#   port configuration: The robot's full configuration.
#   port show_visual: Whether or not to show the robot's visual meshes.
#   port show_collision: Whether or not to show the robot's collision meshes.
#   port show_frames: Whether or not to show the robot's joint frames.
#   port show_base_frame: Whether or not to show the robot's base frame.
#   port show_end_effector_frame: Whether or not to show the robot's end-effector frame.
#   port show_cm: Whether or not to show the collision meshes (if any).
#   port show_acm: Whether or not to show the attached collision meshes (if any).
#   port visual: Rhino meshes of the robot's visual geometry (if any).
#   port collision: Rhino meshes of the robot's collision geometry (if any).
#   port collision_meshes: Rhino meshes of the scene's collision meshes (if any).
#   port attached_meshes: Rhino meshes of the scene's attached collision meshes (if any).
#   port frames: The robot's joint frames as Rhino planes (if any).
#   port base_frame: The robot's base frame as a Rhino plane (if any).
#   port ee_frame: The robot's end-effector frame as a Rhino plane (if any).
# ---------- robot_visualize: Python ----------
"""
Visualizes the robot.

COMPAS FAB v0.27.0
"""
from compas.artists import Artist
from compas.geometry import Frame
from compas.geometry import Transformation
from compas_fab.robots import PlanningScene
from ghpythonlib.componentbase import executingcomponent as component


class RobotVisualize(component):
    def RunScript(
        self,
        robot,
        group,
        configuration,
        show_visual,
        show_collision,
        show_frames,
        show_base_frame,
        show_end_effector_frame,
        show_cm,
        show_acm,
    ):

        visual = None
        collision = None
        collision_meshes = None
        attached_meshes = None
        frames = None
        base_frame = None
        ee_frame = None

        if robot:
            show_visual = True if show_visual is None else show_visual
            show_cm = True if show_cm is None else show_cm
            show_acm = True if show_acm is None else show_acm
            configuration = configuration or robot.zero_configuration()

            robot.update(configuration, visual=show_visual, collision=show_collision)
            compas_frames = robot.transformed_frames(configuration, group)

            if show_visual:
                visual = robot.artist.draw_visual()

            if show_collision:
                collision = robot.artist.draw_collision()

            if show_base_frame:
                base_compas_frame = compas_frames[0]
                artist = Artist(base_compas_frame)
                base_frame = artist.draw()

            if show_end_effector_frame:
                ee_compas_frame = robot.forward_kinematics(
                    configuration, group, options=dict(solver="model")
                )
                artist = Artist(ee_compas_frame)
                ee_frame = artist.draw()

            if show_frames:
                frames = []
                for compas_frame in compas_frames[1:]:
                    artist = Artist(compas_frame)
                    frame = artist.draw()
                    frames.append(frame)

            if show_cm or show_acm:
                scene = PlanningScene(robot)
                scene = robot.client.get_planning_scene()

                collision_meshes = []
                attached_meshes = []

                if show_cm:
                    for co in scene.world.collision_objects:
                        header = co.header
                        frame_id = header.frame_id
                        cms = co.to_collision_meshes()

                        for cm in cms:
                            if cm.frame != Frame.worldXY():
                                t = Transformation.from_frame(cm.frame)
                                mesh = cm.mesh.transformed(t)
                            else:
                                mesh = cm.mesh

                            collision_meshes.append(Artist(mesh).draw())

                if show_acm:
                    for aco in scene.robot_state.attached_collision_objects:
                        for acm in aco.to_attached_collision_meshes():
                            frame_id = aco.object["header"]["frame_id"]
                            frame = robot.forward_kinematics(
                                configuration, options=dict(link=frame_id)
                            )
                            t = Transformation.from_frame(frame)

                            # Local CM frame
                            if (
                                acm.collision_mesh.frame
                                and acm.collision_mesh.frame != Frame.worldXY()
                            ):
                                t = t * Transformation.from_frame(
                                    acm.collision_mesh.frame
                                )

                            mesh = acm.collision_mesh.mesh.transformed(t)

                            attached_meshes.append(Artist(mesh).draw())

        return (
            visual,
            collision,
            collision_meshes,
            attached_meshes,
            frames,
            base_frame,
            ee_frame,
        )
# ---------- end robot_visualize ----------
