# Grasshopper definition 600-pick-and-place.ghx (Grasshopper 1.0.7)

# ----
# 1) Load robot from ROS
# Load the robot from ROS.
# 
# Make sure ROS/MoveIt is running before you start (ie. "Compose up").
# Define the tool and other static meshes
# 
# A tool is composed by a mesh and a frame. If you define only a visual mesh, it will be used for both visual and collision purposes. If the mesh is heavy, make sure you define a simplifed mesh for collision.
# 
# Static collision meshes such as robot's table are also added here.
connect = BooleanToggle(False)
ros = ROSConnect(connect=connect)  # -> ros_client, is_connected; inputs port: Int32, connect: Boolean
#   port ip: The ip address ROS. Defaults to 127.0.0.1.
#   port port: The port of ROS. Defaults to 9090.
#   port connect: If True, connects to ROS. If False, disconnects from ROS. Defaults to False.
#   port ros_client: The ROS client.
#   port is_connected: True if connection established.
# ---------- ros: Python ----------
"""
Connect or disconnect to ROS.

COMPAS FAB v0.27.0
"""
from ghpythonlib.componentbase import executingcomponent as component
from scriptcontext import sticky as st

from compas_fab.backends import RosClient
from compas_fab.ghpython.components import create_id


class ROSConnect(component):
    def RunScript(self, ip, port, connect):
        ros_client = None

        ip = ip or '127.0.0.1'
        port = port or 9090

        key = create_id(self, 'ros_client')
        ros_client = st.get(key, None)

        if ros_client:
            st[key].close()
        if connect:
            st[key] = RosClient(ip, port)
            st[key].run(5)

        ros_client = st.get(key, None)
        is_connected = ros_client.is_connected if ros_client else False
        return (ros_client, is_connected)
# ---------- end ros ----------
load_robot = BooleanToggle(False)
robot = ROSRobot(ros_client=ros.ros_client, load=load_robot)  # -> robot; inputs load: Boolean
#   port ros_client: The ROS client.
#   port load: If True, loads the robot from ROS. Defaults to False.
# ---------- robot: Python ----------
"""
Load robot directly from ROS.

COMPAS FAB v0.27.0
"""
from compas_ghpython.artists import RobotModelArtist
from ghpythonlib.componentbase import executingcomponent as component
from scriptcontext import sticky as st

from compas_fab.ghpython.components import create_id


class ROSRobot(component):
    def RunScript(self, ros_client, load):
        key = create_id(self, 'robot')

        if ros_client and ros_client.is_connected and load:
            # Load URDF from ROS
            st[key] = ros_client.load_robot(load_geometry=True, precision='12f')
            st[key].artist = RobotModelArtist(st[key].model)

        robot = st.get(key, None)
        if robot:  # client sometimes need to be restarted, without needing to reload geometry
            robot.client = ros_client
        return robot
# ---------- end robot ----------
robot_2 = Data(robot)

# ----
# 2) Attach tool and robot table
robot_3 = Data(robot_2)
mesh = Mesh(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)
point = Point(Point(0, 0, 0.07307424083))
mesh_2 = Mesh(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)
xy_plane = XYPlane(Origin=point)
attached_tool = AttachedTool(robot=robot_3, visual_mesh=mesh, tcf_plane=xy_plane)  # -> robot; inputs visual_mesh: Mesh, collision_mesh: Mesh
#   port visual_mesh: A visual mesh for the tool.
#   port collision_mesh: A collision mesh for the tool.
#   port tcf_plane: The frame of the tool in tool0 frame.
#   port group: The planning group to which the tool should be attached.
# ---------- attached_tool: Python ----------
"""
Attach a tool to the robot.

COMPAS FAB v0.27.0
"""
from ghpythonlib.componentbase import executingcomponent as component
from compas_rhino.conversions import RhinoMesh
from compas_rhino.conversions import plane_to_compas_frame

from compas.geometry import Frame
from compas_fab.robots import Tool


class AttachToolComponent(component):
    def RunScript(self, robot, visual_mesh, collision_mesh, tcf_plane, group):
        if robot and robot.client and robot.client.is_connected and visual_mesh:
            if not collision_mesh:
                collision_mesh = visual_mesh

            c_visual_mesh = RhinoMesh.from_geometry(visual_mesh).to_compas()
            c_collision_mesh = RhinoMesh.from_geometry(collision_mesh).to_compas()

            if not tcf_plane:
                frame = Frame.worldXY()
            else:
                frame = plane_to_compas_frame(tcf_plane)
            tool = Tool(c_visual_mesh, frame, c_collision_mesh)

            robot.attach_tool(tool, group)

        return robot
# ---------- end attached_tool ----------
table = GhPythonScript(robot=robot_3, mesh=mesh_2)  # inputs mesh: Mesh
# ---------- table: Python ----------
from compas_fab.robots import PlanningScene
from compas_fab.robots import CollisionMesh
from compas_rhino.conversions import RhinoMesh

if robot:
    scene = PlanningScene(robot)
    mesh = RhinoMesh.from_geometry(mesh).to_compas()
    cm = CollisionMesh(mesh, "table")
    scene.add_collision_mesh(cm)
# ---------- end table ----------
robot_4 = Data(attached_tool)

# ----
# 4) Define assembly
# Define assembly containing parts and frames
# 
# Connectivity is automatically detected and determines sequence
zsize = Slider(0.012, range=0.001..0.0999)
xgap = Slider(0.0018, range=0..0.005)
zgap = Slider(0.0004, range=0..0.005)
xsize = Slider(0.03, range=0.001..0.0999)
ysize = Slider(0.017, range=0.001..0.0999)
current_part_index = Slider(55, range=0..400)
wall_options = GhPythonScript(xsize=xsize, ysize=ysize, zsize=zsize, xgap=xgap, zgap=zgap)  # -> options
# ---------- wall_options: Python ----------
import collections

options = collections.namedtuple('Options', [
    'xsize',
    'ysize',
    'zsize',
    'xgap',
    'zgap',
])

options.xsize = xsize
options.ysize = ysize
options.zsize = zsize
options.xgap = xgap
options.zgap = zgap
# ---------- end wall_options ----------
crv = Curve(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)
crv_2 = Curve(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)
merge = Merge(Data1=crv_2, Data2=crv)
loft = Loft(Curves=merge, Options={Adjust=False, Closed=False, LoftEnds=0, LoftSimp=0, LoftType=0, Rebuild=10, Refit=0.01})
wall = GhPythonScript(surface=loft, options=wall_options)  # -> assembly, parts_geo; inputs surface: Surface
# ---------- wall: Python ----------
import math
import os
import sys

import compas
from compas.geometry import Box
from compas.geometry import Frame
from compas.geometry import Vector
from compas.geometry import Polyhedron
from compas.datastructures import Assembly
from compas.datastructures import Part

from compas.utilities import linspace
from compas_rhino.conversions import RhinoSurface

canvas = ghenv.Component.OnPingDocument()
folder = os.path.dirname(canvas.FilePath)
if folder not in sys.path:
    sys.path.append(folder)

# Default
if not options:
    xsize = 0.0215
    ysize = 0.01025
    zsize = 0.0065
    xgap = 0.0009
    zgap = 0.0002
else:
    xsize = options.xsize
    ysize = options.ysize
    zsize = options.zsize
    xgap = options.xgap
    zgap = options.zgap

surface = RhinoSurface.from_geometry(surface).to_compas()

parts_geo = []

wall_vertical_curve = surface.v_isocurve(0)
wall_height = wall_vertical_curve.length()
courses = int(math.ceil((wall_height / (zsize + zgap))))

assembly = Assembly()
half_brick = Box.from_diagonal([(-xsize / 4, -ysize / 2, 0), (xsize / 4, ysize / 2, -zsize)])
full_brick = Box.from_diagonal([(-xsize / 2, -ysize / 2, 0), (xsize / 2, ysize / 2, -zsize)])

for ri, row in enumerate(linspace(0, 1, courses)):
    _, u = wall_vertical_curve.rhino_curve.NormalizedLengthParameter(row)
    
    row_curve = surface.u_isocurve(u)
    row_length = row_curve.length()

    c = (row_length / (xsize + xgap))
    col_count = int(math.ceil(c))
    linspaced_vector = list(linspace(0, 1, col_count))
    half_brick_offset = linspaced_vector[1] / 2
    
    for ci, l in enumerate(linspaced_vector):
        if ri % 2:
            l += half_brick_offset

        if ci == 0 and ri % 2 == 0:
            l += half_brick_offset / 2
        if ci == col_count - 1 and ri % 2 == 0:
            l -= half_brick_offset / 2

        fits, col = row_curve.rhino_curve.NormalizedLengthParameter(l)
        if not fits: break

        point = row_curve.point_at(col)
        xaxis = row_curve.tangent_at(col)
        frame = Frame(point, xaxis, xaxis.cross(Vector.Zaxis()))

        if ri % 2 == 0 and ci in (0, col_count - 1):
            brick = half_brick.copy()
        else:
            brick = full_brick.copy()
            
        brick_shape = Polyhedron(*brick.to_vertices_and_faces(triangulated=True))
        part = Part(
            shape=brick_shape,
            frame=frame,
            course=ri,
            n=ci,
            xsize=brick.xsize,
            ysize=brick.ysize,
            zsize=brick.zsize,
        )
        assembly.add_part(part)

# Assembly attributes
assembly.attributes['courses'] = ri

parts_geo = [part.geometry for part in assembly.parts()]
#
#if save:
#    compas.json_dump({'assembly': assembly}, os.path.join(folder, 'session.json'), pretty=True)
# ---------- end wall ----------
edges = GhPythonScript(assembly=wall.assembly)  # -> assembly
# ---------- edges: Python ----------
import math
import os

import compas
from compas.geometry import Box
from compas.geometry import Plane
from compas.geometry import Frame
from compas.geometry import Vector
from compas.geometry import Translation
from compas.geometry import Polygon
from compas.geometry import Projection
from compas.datastructures import Mesh
from separation_axis_theorem import separating_axis_theorem

canvas = ghenv.Component.OnPingDocument()
folder = os.path.dirname(canvas.FilePath)

projection = Projection.from_plane(Plane.worldXY())

for part in assembly.parts():
    # Store XY projection
    projected_mesh = Mesh.from_shape(part.geometry.transformed(projection))
    part.attributes['projection'] = Polygon(projected_mesh.face_coordinates(0))

    # Calculate place frame
    part.attributes['place_frame'] = part.frame.transformed(Translation.from_vector([0, 0, part.attributes['zsize']]))

# Connect assembly graph
last_course_parts = None
for c in range(assembly.attributes['courses'] + 1):
    course_parts = list(assembly.graph.nodes_where_predicate(lambda key, attr: attr['part'].attributes['course'] == c))

    if last_course_parts:
        for key in course_parts:
            part1 = assembly.find_by_key(key)
            polygon1 = part1.attributes['projection']

            for p2_key in last_course_parts:
                part2 = assembly.find_by_key(p2_key)
                polygon2 = part2.attributes['projection']
                are_connected = separating_axis_theorem(polygon1.points, polygon2.points)
                if are_connected:
                    assembly.add_connection(part2, part1)

    last_course_parts = course_parts
#
#if save:
#    compas.json_dump({'assembly': assembly}, os.path.join(folder, 'session.json'), pretty=True)
# ---------- end edges ----------
frames = GhPythonScript(assembly=edges, current_part_index=current_part_index)  # -> current_part, place_frame, a; inputs current_part_index: Int32
# ---------- frames: Python ----------
from helpers import traverse
from helpers import draw_parts
from helpers import draw_connections
from helpers import draw_parts_attribute
from helpers import get_assembly_sequence
from compas.artists import Artist


a = []
a += draw_parts_attribute(assembly, 'place_frame')

top_course = assembly.attributes["courses"]
sequence = get_assembly_sequence(assembly, top_course)

for i in range(current_part_index):
    part = assembly.find_by_key(sequence[i])
    if (current_part_index-1) == i:
        place_frame = part.attributes['place_frame']
        current_part = part
# ---------- end frames ----------
viz = GhPythonScript(assembly=edges)  # -> out, a
# ---------- viz: Python ----------
import compas_ghpython
from compas.artists import Artist

def draw_connections(assembly):
    lines = []

    for u, v in assembly.connections():
        u = assembly.find_by_key(u)
        v = assembly.find_by_key(v)
        lines.append(
            {
                "start": list(u.frame.point),
                "end": list(v.frame.point),
            }
        )
    return compas_ghpython.draw_lines(lines)

a = []
a += draw_connections(assembly)
# ---------- end viz ----------
current_part_index_2 = Data(current_part_index)
target_plane = Data(frames.place_frame)
draw = Draw(cg=frames.place_frame)  # -> rg
#   port cg: The COMPAS geometry or datastructure to be drawn.
#   port rg: The Rhino geometry object.
# ---------- draw: Python ----------
"""
Draws COMPAS geometry in Grasshopper.
"""
from ghpythonlib.componentbase import executingcomponent as component

from compas.artists import Artist


class CompasToRhinoGeometry(component):
    def RunScript(self, cg):
        if not cg:
            return None

        return Artist(cg).draw()
# ---------- end draw ----------
assembly = Data(edges)

# ----
# 3) Define pick-up plane
# Define one pick-up plane in any way you like,
# for example, reference a point from Rhino and assign a plane to it.
# 
# Make sure the plane is oriented in a way that makes sense
# for the robot to reach it. You can check this by observing the
# results of the IK solution for this pickup-plane.
pt = Point(Point(-0.303308126, -0.5079005346, 0.02344175302))
xy = XYPlane(Origin=pt)
pflip = FlipPlane(Plane=xy, ReverseX=False, ReverseY=False, SwapAxes=True)
pickup_plane = Data(pflip)

# ----
# 5) Solve all IK
# Results in 4 configurations
target_plane_2 = Data(target_plane)
# Use inverse kinematics of the robot to find
# feasible configurations to reach all planes of the current part.
# 
# In this case, we code the solution for a more compact visualization.
robot_5 = Data(robot_4)
pickup_plane_2 = Data(pickup_plane)
approach_distance = Slider(0.1, range=0.01..0.1)
planning = GhPythonScript(robot=robot_5, place_frame=target_plane_2, pick_frame=pickup_plane_2, approach_distance=approach_distance)  # -> pick_config, approach_pick_config, place_config, approach_place_config
# ---------- planning: Python ----------
from compas_rhino.conversions import RhinoPlane

if robot and robot.client:
    start_configuration = robot.zero_configuration()
    
    place_config = robot.inverse_kinematics(place_frame, start_configuration)

    approach_place_frame = place_frame.copy()
    approach_place_frame.point.z += approach_distance
    approach_place_config = robot.inverse_kinematics(approach_place_frame, place_config)

    pick_frame = RhinoPlane.from_geometry(pick_frame).to_compas_frame()

    approach_pick_frame = pick_frame.copy()
    approach_pick_frame.point.z += approach_distance

    approach_pick_config = robot.inverse_kinematics(approach_pick_frame, approach_place_config)

    pick_config = robot.inverse_kinematics(pick_frame, approach_place_config)
# ---------- end planning ----------
approach_pickup_config = Data(planning.approach_pick_config)
approach_place_config = Data(planning.approach_place_config)
pickup_config = Data(planning.pick_config)
place_config = Data(planning.place_config)

approach_place_config_2 = Data(approach_place_config)
approach_pickup_config_2 = Data(approach_pickup_config)

# ----
# 6) Plan trajectory to approach plane
# From approach pickup config to approach target plane
robot_6 = Data(robot_4)
constraints_from_target_configuration = ConstraintsFromTargetConfiguration(robot=robot_6, target_configuration=approach_place_config_2)  # -> constraints
#   port target_configuration: The target configuration.
#   port tolerance_above: The tolerances above the targeted joint value of each configurable joint, defining the upper bound in radians/meters to be achieved.
#   port tolerance_below: The tolerances below the targeted joint value of each configurable joint, defining the lower bound in radians/meters to be achieved.
#   port group: The planning group for which we specify the constraint. Defaults to the robot's main planning group.
#   port constraints: A list joint constraints in radians/meters.
# ---------- constraints_from_target_configuration: Python ----------
"""
Create joint constraints for each of the robot's configurable joints based on a given target configuration.

COMPAS FAB v0.27.0
"""
import math

from ghpythonlib.componentbase import executingcomponent as component


class ConstraintsFromTargetConfiguration(component):

    DEFAULT_TOLERANCE_METERS = .001
    DEFAULT_TOLERANCE_RADIANS = math.radians(1)

    def RunScript(self, robot, target_configuration, tolerance_above, tolerance_below, group):
        if robot and target_configuration:
            tolerance_above = tolerance_above or self._generate_default_tolerances(robot.get_configurable_joints(group))
            tolerance_below = tolerance_below or self._generate_default_tolerances(robot.get_configurable_joints(group))

            constraints = robot.constraints_from_configuration(
                configuration=target_configuration,
                tolerances_above=tolerance_above,
                tolerances_below=tolerance_below,
                group=group
            )

            return constraints

    def _generate_default_tolerances(self, joints):
        return [
            self.DEFAULT_TOLERANCE_METERS if j.is_scalable()
            else self.DEFAULT_TOLERANCE_RADIANS
            for j in joints
        ]
# ---------- end constraints_from_target_configuration ----------
plan_motion = PlanMotion(
    robot=robot_6,
    goal_constraints=constraints_from_target_configuration,
    start_configuration=approach_pickup_config_2,
    compute=Button())  # -> trajectory; inputs goal_constraints: list, attached_collision_meshes: list, path_constraints: list, compute: Boolean
#   port goal_constraints: The goal to be achieved, defined in a set of constraints. Constraints can be very specific, for example defining value domains for each joint, such that the goal configuration is included, or defining a volume in space, to which a specific robot link (e.g. the end-effector) is required to move to.
#   port start_configuration: The robot's full configuration, i.e. values for all configurable joints of the entire robot, at the starting position. Defaults to the all-zero configuration.
#   port group: The planning group used for calculation. Defaults to the robot's main planning group.
#   port attached_collision_meshes: A list of attached collision meshes to be included for planning.
#   port path_constraints: Optional constraints that can be imposed along the solution path. Note that path calculation won't work if the start_configuration violates these constraints. Defaults to None.
#   port planner_id: The name of the algorithm used for path planning. Defaults to 'RRTConnect'
#   port compute: If True, calculates a trajectory.
#   port trajectory: The calculated trajectory.
# ---------- plan_motion: Python ----------
"""
Calculate a motion path.

COMPAS FAB v0.27.0
"""
from ghpythonlib.componentbase import executingcomponent as component
from scriptcontext import sticky as st

from compas_fab.ghpython.components import create_id


class PlanMotion(component):
    def RunScript(self, robot, goal_constraints, start_configuration, group, attached_collision_meshes, path_constraints, planner_id, compute):

        key = create_id(self, 'trajectory')

        path_constraints = list(path_constraints) if path_constraints else None
        attached_collision_meshes = list(attached_collision_meshes) if attached_collision_meshes else None
        planner_id = str(planner_id) if planner_id else 'RRTConnect'

        if robot and robot.client and robot.client.is_connected and start_configuration and goal_constraints and compute:
            st[key] = robot.plan_motion(goal_constraints,
                                        start_configuration=start_configuration,
                                        group=group,
                                        options=dict(
                                            attached_collision_meshes=attached_collision_meshes,
                                            path_constraints=path_constraints,
                                            planner_id=planner_id,
                                        ))

        trajectory = st.get(key, None)
        return trajectory
# ---------- end plan_motion ----------
trajectory_visualize = TrajectoryVisualize(robot=robot_6, trajectory=plan_motion)  # -> start_configuration, configurations, fraction, time, planes, P, V, A
#   port group: The planning group for which this trajectory was planned.
#   port trajectory: The calculated trajectory.
#   port start_configuration: The start configuration of the trajectory.
#   port configurations: The full configurations along the trajectory.
#   port fraction: Indicates the fraction of requested trajectory that was calculated, e.g. 1 means the full trajectory was found.
#   port time: The time which is needed to execute that trajectory at full speed.
#   port planes: The planes of the robot's end-effector.
#   port P: The positions along the trajectory
#   port V: The velocities along the trajectory
#   port A: The accelerations along the trajectory
# ---------- trajectory_visualize: Python ----------
"""
Visualizes a trajectory.

COMPAS FAB v0.27.0
"""
from compas_ghpython import draw_frame
from compas_ghpython import list_to_ghtree
from ghpythonlib.componentbase import executingcomponent as component


class TrajectoryVisualize(component):
    def RunScript(self, robot, group, trajectory):
        start_configuration = None
        configurations = []
        fraction = 0.
        time = 0.

        planes = []
        positions = []
        velocities = []
        accelerations = []

        if robot and trajectory:
            group = group or robot.main_group_name

            for c in trajectory.points:
                configurations.append(robot.merge_group_with_full_configuration(c, trajectory.start_configuration, group))
                frame = robot.forward_kinematics(c, group, options=dict(solver='model'))
                planes.append(draw_frame(frame))
                positions.append(c.positions)
                velocities.append(c.velocities)
                accelerations.append(c.accelerations)

            start_configuration = trajectory.start_configuration
            fraction = trajectory.fraction
            time = trajectory.time_from_start

        P = list_to_ghtree(list(zip(*positions)))
        V = list_to_ghtree(list(zip(*velocities)))
        A = list_to_ghtree(list(zip(*accelerations)))

        # return outputs if you have them; here I try it for you:
        return (start_configuration, configurations, fraction, time, planes, P, V, A)
# ---------- end trajectory_visualize ----------
trajectory = Data(plan_motion)

# ----
# Visualization
# Assembly visualization
robot_7 = Data(robot_4)
approach_pickup_config_3 = Data(approach_pickup_config)
pickup_config_2 = Data(pickup_config)
approach_place_config_3 = Data(approach_place_config)
place_config_2 = Data(place_config)
trajectory_2 = Data(trajectory)
list = ValueList({"Approach pickup config": 0, "Pickup config": 1, "Approach place config": 2, "Place config": 3, "Trajectory": 4, "All combined": 5}, selected="All combined")
assembly_2 = Data(assembly)
current_part_index_3 = Data(current_part_index_2)
get_configs = GhPythonScript(trajectory=trajectory_2)  # -> configs
# ---------- get_configs: Python ----------
configs = trajectory.points
# ---------- end get_configs ----------
merge_2 = GhPythonScript(
    approach_pick_config=approach_pickup_config_3,
    pick_config=pickup_config_2,
    approach_place_config=approach_place_config_3,
    place_config=place_config_2,
    trajectory=trajectory_2)  # -> out, a
# ---------- merge_2: Python ----------
a = [approach_pick_config, pick_config, approach_pick_config]
a.extend(trajectory.points)
a += [approach_place_config, place_config, approach_place_config]
# ---------- end merge_2 ----------
filter = StreamFilter(
    Gate=list,
    Stream0=approach_pickup_config_3,
    Stream1=pickup_config_2,
    Stream2=approach_place_config_3,
    Stream3=place_config_2,
    Stream4=get_configs,
    Stream5=merge_2.a)
item = ListItem(List=filter, Index=Slider(0, range=0..100), Wrap=True)
robot_visualize = RobotVisualize(robot=robot_7, configuration=item)  # -> visual, collision, collision_meshes, attached_meshes, frames, base_frame, ee_frame; inputs show_visual: Boolean, show_collision: Boolean, show_frames: Boolean, show_base_frame: Boolean, show_end_effector_frame: Boolean, show_cm: Boolean, show_acm: Boolean
#   port group: The planning group used for end-effector and base visualization.
#   port configuration: The robot's full configuration.
#   port show_visual: Whether or not to show the robot's visual meshes.
#   port show_collision: Whether or not to show the robot's collision meshes.
#   port show_frames: Whether or not to show the robot's joint frames.
#   port show_base_frame: Whether or not to show the robot's base frame.
#   port show_end_effector_frame: Whether or not to show the robot's end-effector frame.
#   port show_cm: Whether or not to show the collision meshes (if any).
#   port show_acm: Whether or not to show the attached collision meshes (if any).
#   port visual: Rhino meshes of the robot's visual geometry (if any).
#   port collision: Rhino meshes of the robot's collision geometry (if any).
#   port collision_meshes: Rhino meshes of the scene's collision meshes (if any).
#   port attached_meshes: Rhino meshes of the scene's attached collision meshes (if any).
#   port frames: The robot's joint frames as Rhino planes (if any).
#   port base_frame: The robot's base frame as a Rhino plane (if any).
#   port ee_frame: The robot's end-effector frame as a Rhino plane (if any).
# ---------- robot_visualize: Python ----------
"""
Visualizes the robot.

COMPAS FAB v0.27.0
"""
from compas.artists import Artist
from compas.geometry import Frame
from compas.geometry import Transformation
from compas_fab.robots import PlanningScene
from ghpythonlib.componentbase import executingcomponent as component


class RobotVisualize(component):
    def RunScript(
        self,
        robot,
        group,
        configuration,
        show_visual,
        show_collision,
        show_frames,
        show_base_frame,
        show_end_effector_frame,
        show_cm,
        show_acm,
    ):

        visual = None
        collision = None
        collision_meshes = None
        attached_meshes = None
        frames = None
        base_frame = None
        ee_frame = None

        if robot:
            show_visual = True if show_visual is None else show_visual
            show_cm = True if show_cm is None else show_cm
            show_acm = True if show_acm is None else show_acm
            configuration = configuration or robot.zero_configuration()

            robot.update(configuration, visual=show_visual, collision=show_collision)
            compas_frames = robot.transformed_frames(configuration, group)

            if show_visual:
                visual = robot.artist.draw_visual()

            if show_collision:
                collision = robot.artist.draw_collision()

            if show_base_frame:
                base_compas_frame = compas_frames[0]
                artist = Artist(base_compas_frame)
                base_frame = artist.draw()

            if show_end_effector_frame:
                ee_compas_frame = robot.forward_kinematics(
                    configuration, group, options=dict(solver="model")
                )
                artist = Artist(ee_compas_frame)
                ee_frame = artist.draw()

            if show_frames:
                frames = []
                for compas_frame in compas_frames[1:]:
                    artist = Artist(compas_frame)
                    frame = artist.draw()
                    frames.append(frame)

            if show_cm or show_acm:
                scene = PlanningScene(robot)
                scene = robot.client.get_planning_scene()

                collision_meshes = []
                attached_meshes = []

                if show_cm:
                    for co in scene.world.collision_objects:
                        header = co.header
                        frame_id = header.frame_id
                        cms = co.to_collision_meshes()

                        for cm in cms:
                            if cm.frame != Frame.worldXY():
                                t = Transformation.from_frame(cm.frame)
                                mesh = cm.mesh.transformed(t)
                            else:
                                mesh = cm.mesh

                            collision_meshes.append(Artist(mesh).draw())

                if show_acm:
                    for aco in scene.robot_state.attached_collision_objects:
                        for acm in aco.to_attached_collision_meshes():
                            frame_id = aco.object["header"]["frame_id"]
                            frame = robot.forward_kinematics(
                                configuration, options=dict(link=frame_id)
                            )
                            t = Transformation.from_frame(frame)

                            # Local CM frame
                            if (
                                acm.collision_mesh.frame
                                and acm.collision_mesh.frame != Frame.worldXY()
                            ):
                                t = t * Transformation.from_frame(
                                    acm.collision_mesh.frame
                                )

                            mesh = acm.collision_mesh.mesh.transformed(t)

                            attached_meshes.append(Artist(mesh).draw())

        return (
            visual,
            collision,
            collision_meshes,
            attached_meshes,
            frames,
            base_frame,
            ee_frame,
        )
# ---------- end robot_visualize ----------
assembly_3 = GhPythonScript(assembly=assembly_2, current_part_index=current_part_index_3)  # -> current_part, place_frame, a; inputs current_part_index: Int32
# ---------- assembly_3: Python ----------
from helpers import traverse
from helpers import draw_parts
from helpers import draw_connections
from helpers import draw_parts_attribute
from helpers import get_assembly_sequence
from compas.artists import Artist


a = []
a = draw_parts(assembly)
a += draw_connections(assembly)
a += draw_parts_attribute(assembly, 'place_frame')

top_course = assembly.attributes["courses"]
sequence = get_assembly_sequence(assembly, top_course)

for i in range(current_part_index):
    part = assembly.find_by_key(sequence[i])
    if (current_part_index-1) == i:
        place_frame = part.attributes['place_frame']
        current_part = part

    a += [Artist(part.geometry).draw()]
# ---------- end assembly_3 ----------
