# Grasshopper definition 700-pick-and-place-control_01.06.2023_LATEST.gh (Grasshopper 1.0.7)
# plug-ins: NGon, Pufferfish

U = Slider(15, range=0..30)
V = Slider(10, range=0..10)

# ---- group: BENDY CURVES
crv = Curve(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)
crv_2 = Curve(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)

# ---- group: STRAIGHT CURVES
crv_3 = Curve(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)
crv_4 = Curve(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)

# ---- group: BENDY CURVES
crv_5 = Curve(crv)
crv_6 = Curve(crv_2)

# ----
panel = Panel("""0.0115
0.0155""")
cluster = Cluster(curve_a=crv_5, curve_b=crv_6, u_count=U, v_count=V)  # -> surface, u_isocurve, v_isocurve
cluster_2 = Cluster(curve_a=crv_5, curve_b=crv_6, u_count=U, v_count=V)  # -> surface, u_isocurve, v_isocurve
join_curves = JoinCurves(Curves=flatten(cluster.v_isocurve), Preserve=False)
join_curves_2 = JoinCurves(Curves=flatten(cluster_2.v_isocurve), Preserve=False)
surface = Surface(cluster.surface)
curve = Curve(cluster.u_isocurve)
curve_2 = Curve(cluster.v_isocurve)
brickoffset = Slider(0.001, range=0..0.005)

# ----
# 4) Define pick-up plane
pt = Point(Point(0.4468751352, -0.5079005346, 0.02344175302))
xy = XYPlane(Origin=pt)
pflip = FlipPlane(Plane=xy, ReverseX=False, ReverseY=False, SwapAxes=True)
pickup_plane = Data(Plane(origin=(0.449496581, -0.5105427583, 0.03681838202), x=(0.6191969634, -0.7852356686, 0.0002556999085), y=(-0.7849190153, -0.6189564485, -0.02819670562)))

divide_distance = DivideDistance(Curve=curve_2, Distance=panel)  # -> Points, Tangents, Parameters
null_item = NullItem(Item=join_curves)  # -> NullFlags, InvalidFlags, Description
null_item_2 = NullItem(Item=join_curves_2)  # -> NullFlags, InvalidFlags, Description
dispatch = Dispatch(List=join_curves, DispatchPattern=null_item.InvalidFlags)  # -> ListA, ListB
length = Length(Curve=dispatch.ListB)
sort_list = SortList(Keys=length)  # -> Keys, ValuesValuesA
list_item = ListItem(List=sort_list.Keys, Index=0, Wrap=True)
dispatch_2 = Dispatch(List=join_curves_2, DispatchPattern=null_item_2.InvalidFlags)  # -> ListA, ListB
panel_2 = Panel("""130
-50
-150
-10
-79
5""")
crv_7 = Curve(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)
crv_8 = Curve(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)
dispatch_3 = Dispatch(List=dispatch.ListB, DispatchPattern=[True, False])  # -> ListA, ListB
dispatch_4 = Dispatch(List=dispatch_2.ListB, DispatchPattern=[True, False])  # -> ListA, ListB
curve_3 = Curve(dispatch_3.ListA)
curve_4 = Curve(dispatch_3.ListB)
curve_5 = Curve(dispatch_4.ListB)
division = Division(A=U, B=2)
integer = Integer(division)
clay = Panel("-0.0165")
timber = Panel("-0.020")
flip_curve = FlipCurve(Curve=curve_5)  # -> Curve, Flag
construct_point = ConstructPoint(XCoordinate="-0.015", YCoordinate="0.005", ZCoordinate=timber)
move = Move(Geometry=pickup_plane, Motion=construct_point)  # -> Geometry, Transform
boolean_toggle = BooleanToggle(True)
construct_domain = ConstructDomain(DomainStart=0, DomainEnd=40)
construct_domain_2 = ConstructDomain(DomainStart=-40, DomainEnd=0)
custom_preview = CustomPreview(Geometry=surface, Material=ColourSwatch(SwatchColor=RGBA(255, 255, 255, 109)))
addition = Addition(A=Slider(0.0115, range=0..0.1), B=Slider(0.016, range=0..100))
number_slider = Slider(0.016, range=0..100)
series = Series(Start=Slider(0.016, range=0..100), Step=addition, Count=Slider(7, range=0..10))
unit_z = UnitZ(Factor=series)  # -> simplify(graft(UnitVector))
panel_3 = Panel(unit_z)
number_slider_2 = Slider(0, range=0..100)
addition_2 = Addition(A=number_slider, B=number_slider)
addition_3 = Addition(A=Slider(0.0115, range=0..0.1), B=Slider(0.016, range=0..100))
xsize = Slider(0.032, range=0.001..0.0999)
ysize = Slider(0.0155, range=0.001..0.0999)
zsize = Slider(0.0115, range=0.001..0.0999)
xsize_2 = Slider(0.032, range=0.001..0.0999)
zsize_2 = Slider(0.0115, range=0.001..0.0999)
ysize_2 = Slider(0.0155, range=0.001..0.0999)
series_2 = Series(Start=addition_2, Step=addition_3, Count=Slider(7, range=0..10))
unit_z_2 = UnitZ(Factor=series_2)  # -> simplify(graft(UnitVector))
unit_z_3 = UnitZ(Factor=Slider(-0.00228, range=-0.01..0))
weave = Weave(Pattern=[0, 1], Stream0="0.0115", Stream1="0.0155", NullGaps=False)
repeat_data = RepeatData(Data=weave, Length=Slider(2, range=0..12))
move_2 = Move(Motion=Vector(0, 0, 10))  # -> Geometry, Transform

# ----
# 1) Load robot from ROS
connect = BooleanToggle(True)
load_robot = BooleanToggle(True)

ros_connect = ROSConnect(connect=connect)  # -> ros_client, is_connected; inputs port: Int32, connect: Boolean
#   port ip: The ip address ROS. Defaults to 127.0.0.1.
#   port port: The port of ROS. Defaults to 9090.
#   port connect: If True, connects to ROS. If False, disconnects from ROS. Defaults to False.
#   port ros_client: The ROS client.
#   port is_connected: True if connection established.
# ---------- ros_connect: Python ----------
"""
Connect or disconnect to ROS.

COMPAS FAB v0.27.0
"""
from ghpythonlib.componentbase import executingcomponent as component
from scriptcontext import sticky as st

from compas_fab.backends import RosClient
from compas_fab.ghpython.components import create_id


class ROSConnect(component):
    def RunScript(self, ip, port, connect):
        ros_client = None

        ip = ip or '127.0.0.1'
        port = port or 9090

        key = create_id(self, 'ros_client')
        ros_client = st.get(key, None)

        if ros_client:
            st[key].close()
        if connect:
            st[key] = RosClient(ip, port)
            st[key].run(5)

        ros_client = st.get(key, None)
        is_connected = ros_client.is_connected if ros_client else False
        return (ros_client, is_connected)
# ---------- end ros_connect ----------

robot = ROSRobot(ros_client=ros_connect.ros_client, load=load_robot)  # -> robot; inputs load: Boolean
#   port ros_client: The ROS client.
#   port load: If True, loads the robot from ROS. Defaults to False.
# ---------- robot: Python ----------
"""
Load robot directly from ROS.

COMPAS FAB v0.27.0
"""
from compas_ghpython.artists import RobotModelArtist
from ghpythonlib.componentbase import executingcomponent as component
from scriptcontext import sticky as st

from compas_fab.ghpython.components import create_id


class ROSRobot(component):
    def RunScript(self, ros_client, load):
        key = create_id(self, 'robot')

        if ros_client and ros_client.is_connected and load:
            # Load URDF from ROS
            st[key] = ros_client.load_robot(load_geometry=True, precision='12f')
            st[key].artist = RobotModelArtist(st[key].model)

        robot = st.get(key, None)
        if robot:  # client sometimes need to be restarted, without needing to reload geometry
            robot.client = ros_client
        return robot
# ---------- end robot ----------
robot_2 = Data(robot)

# ----
# 3) Attach tool and robot table
robot_3 = Data(robot_2)
mesh = Mesh(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)
point = Point(Point(0, 0, 0.1158842008))
mesh_2 = Mesh(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)
xy_plane = XYPlane(Origin=point)
attached_tool = AttachedTool(robot=robot_3, visual_mesh=mesh, tcf_plane=xy_plane)  # -> robot; inputs visual_mesh: Mesh, collision_mesh: Mesh
#   port visual_mesh: A visual mesh for the tool.
#   port collision_mesh: A collision mesh for the tool.
#   port tcf_plane: The frame of the tool in tool0 frame.
#   port group: The planning group to which the tool should be attached.
# ---------- attached_tool: Python ----------
"""
Attach a tool to the robot.

COMPAS FAB v0.27.0
"""
from ghpythonlib.componentbase import executingcomponent as component
from compas_rhino.conversions import RhinoMesh
from compas_rhino.conversions import plane_to_compas_frame

from compas.geometry import Frame
from compas_fab.robots import Tool


class AttachToolComponent(component):
    def RunScript(self, robot, visual_mesh, collision_mesh, tcf_plane, group):
        if robot and robot.client and robot.client.is_connected and visual_mesh:
            if not collision_mesh:
                collision_mesh = visual_mesh

            c_visual_mesh = RhinoMesh.from_geometry(visual_mesh).to_compas()
            c_collision_mesh = RhinoMesh.from_geometry(collision_mesh).to_compas()

            if not tcf_plane:
                frame = Frame.worldXY()
            else:
                frame = plane_to_compas_frame(tcf_plane)
            tool = Tool(c_visual_mesh, frame, c_collision_mesh)

            robot.attach_tool(tool, group)

        return robot
# ---------- end attached_tool ----------
table = GhPythonScript(robot=robot_3, mesh=mesh_2)  # inputs mesh: Mesh
# ---------- table: Python ----------
from compas_fab.robots import PlanningScene
from compas_fab.robots import CollisionMesh
from compas_rhino.conversions import RhinoMesh

if robot:
    scene = PlanningScene(robot)
    mesh = RhinoMesh.from_geometry(mesh).to_compas()
    cm = CollisionMesh(mesh, "table")
    scene.add_collision_mesh(cm)
# ---------- end table ----------
robot_4 = Data(attached_tool)

zero_config = ZeroConfig(robot=robot)  # -> config
#   port group: If assigned, it will return the zero configuration for the given group, otherwise a full zero configuration.
#   port config: The zero configuration.
# ---------- zero_config: Python ----------
"""
Get a zero configuration for a robot.

COMPAS FAB v0.27.0
"""
from ghpythonlib.componentbase import executingcomponent as component


class ConfigZero(component):
    def RunScript(self, robot, group):

        if robot:
            return robot.zero_configuration(group)

        return None
# ---------- end zero_config ----------
ghpython_script = GhPythonScript(x=zero_config, joints=panel_2)  # -> out, x; inputs joints: list
# ---------- ghpython_script: Python ----------
import math

x.joint_values = [math.radians(j) for j in joints]
# ---------- end ghpython_script ----------

# ----
# 5) Solve all IK
# Results in 4 configurations
# Use inverse kinematics of the robot to find
# feasible configurations to reach all planes of the current part.
# 
# In this case, we code the solution for a more compact visualization.
pickup_plane_2 = Data(move.Geometry)
robot_5 = Data(robot_4)
button = Button()
button_2 = Button()

# ----
# 6) Plan trajectories
robot_6 = Data(robot_4)
button_3 = Button()

# ----
# 2) Define assembly
xsize_3 = Slider(0.032, range=0.001..0.0999)
ysize_3 = Slider(0.02, range=0.001..0.0999)
zsize_3 = Slider(0.015, range=0.001..0.0999)
xgap = Slider(0.005, range=0..0.005)
zgap = Slider(0.0001, range=0..0.005)
wall_options = GhPythonScript(xsize=xsize_3, ysize=ysize_3, zsize=zsize_3, xgap=xgap, zgap=zgap, brickoffset=brickoffset)  # -> options
# ---------- wall_options: Python ----------
import collections

options = collections.namedtuple('Options', [
    'xsize',
    'ysize',
    'zsize',
    'xgap',
    'zgap',
    'brickoffset',
])

options.xsize = xsize
options.ysize = ysize
options.zsize = zsize
options.xgap = xgap
options.zgap = zgap
options.brickoffset = brickoffset
# ---------- end wall_options ----------
crv_9 = Curve(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)
crv_10 = Curve(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)
merge = Merge(Data1=crv_10, Data2=crv_9)
loft = Loft(Curves=merge, Options={Adjust=False, Closed=False, LoftEnds=0, LoftSimp=0, LoftType=0, Rebuild=10, Refit=0.01})
current_part_index = Slider(68, range=0..400)
current_part_index_2 = Data(current_part_index)

cluster_3 = Cluster_2(curve=cluster.u_isocurve, B=xsize_3)
division_2 = Division(A=list_item, B=zsize_3)
integer_2 = Integer(division_2)
panel_4 = Panel(cluster_3)
# Load the robot from ROS.
# 
# Make sure ROS/MoveIt is running before you start (ie. "Compose up").
# Define assembly containing parts and frames
# 
# Connectivity is automatically detected and determines sequence
addition_4 = Addition(A=xsize_3, B=0.011)
# Define the tool and other static meshes
# 
# A tool is composed by a mesh and a frame. If you define only a visual mesh, it will be used for both visual and collision purposes. If the mesh is heavy, make sure you define a simplifed mesh for collision.
# 
# Static collision meshes such as robot's table are also added here.
# Define one pick-up plane in any way you like,
# for example, reference a point from Rhino and assign a plane to it.
# 
# Make sure the plane is oriented in a way that makes sense
# for the robot to reach it. You can check this by observing the
# results of the IK solution for this pickup-plane.
addition_5 = Addition(A=ysize_3, B=0.02)

divide_curve = DivideCurve(Curve=curve_3, Count=integer_2, Kinks=False)  # -> Points, Tangents, Parameters
dispatch_5 = Dispatch(List=divide_curve.Points, DispatchPattern=[True, False])  # -> ListA, ListB
division_3 = Division(A=xsize_3, B=2)
division_4 = Division(A=ysize_3, B=2)
point_2 = Point(dispatch_5.ListA)
point_3 = Point(dispatch_5.ListB)
xy_plane_2 = XYPlane(Origin=point_2)
construct_domain_3 = ConstructDomain(DomainStart=division_4, DomainEnd=expr("-x", division_4))
construct_domain_4 = ConstructDomain(DomainStart=division_3, DomainEnd=expr("-x", division_3))
list_length = ListLength(List=curve_3)
rectangle = Rectangle(Plane=xy_plane_2, XSize=construct_domain_3, YSize=construct_domain_4, Radius=0)  # -> Rectangle, Length
unit_z_4 = UnitZ(Factor=zsize_3)
surface_2 = Surface(rectangle.Rectangle)
extrude = Extrude(Base=surface_2, Direction=unit_z_4)
explode_tree = ExplodeTree(Data=extrude)
volume = Volume(Geometry=extrude)  # -> Volume, Centroid
list_length_2 = ListLength(List=explode_tree)
xy_plane_3 = XYPlane(Origin=volume.Centroid)
series_3 = Series(Start=0, Step=Slider(0, range=0..30), Count=list_length)
series_4 = Series(Start=series_3, Step=Slider(0, range=0..30), Count=list_length_2)
rotate = Rotate(Geometry=extrude, Angle=degrees(series_4), Plane=xy_plane_3)  # -> flatten(Geometry), Transform

divide_curve_2 = DivideCurve(Curve=flip_curve.Curve, Count=integer_2, Kinks=False)  # -> Points, Tangents, Parameters
dispatch_6 = Dispatch(List=divide_curve_2.Points, DispatchPattern=[True, False])  # -> ListA, ListB
point_4 = Point(dispatch_6.ListA)
point_5 = Point(dispatch_6.ListB)
xy_plane_4 = XYPlane(Origin=point_5)
rectangle_2 = Rectangle(Plane=xy_plane_4, XSize=construct_domain_3, YSize=construct_domain_4, Radius=0)  # -> Rectangle, Length
list_length_3 = ListLength(List=curve_5)
unit_z_5 = UnitZ(Factor=zsize_3)
surface_3 = Surface(rectangle_2.Rectangle)
extrude_2 = Extrude(Base=surface_3, Direction=unit_z_5)
explode_tree_2 = ExplodeTree(Data=extrude_2)  # -> Branch0, Branch1, Branch2, Branch3, Branch4, Branch5, Branch6, Branch7
volume_2 = Volume(Geometry=extrude_2)  # -> Volume, Centroid
list_length_4 = ListLength(List=explode_tree_2.Branch0)
xy_plane_5 = XYPlane(Origin=volume_2.Centroid)
series_5 = Series(Start=0, Step=Slider(5, range=-45..30), Count=list_length_3)
series_6 = Series(Start=series_5, Step=Slider(10, range=0..30), Count=list_length_4)
rotate_2 = Rotate(Geometry=extrude_2, Angle=degrees(series_6), Plane=xy_plane_5)  # -> flatten(Geometry), Transform

bounds = Bounds(Numbers=flatten(series_6))
bounds_2 = Bounds(Numbers=flatten(series_4))
remap_numbers = RemapNumbers(Value=series_6, Source=bounds, Target=construct_domain)  # -> Mapped, Clipped
remap_numbers_2 = RemapNumbers(Value=series_4, Source=bounds_2, Target=construct_domain_2)  # -> Mapped, Clipped
partition_list = PartitionList(List=rotate.Geometry, Size=V)  # -> simplify(Chunks)
list_item_2 = ListItem(List=rotate.Geometry, Index=Slider(38, range=0..100), Wrap=True)
list_length_5 = ListLength(List=[rotate.Geometry, rotate_2.Geometry])
panel_5 = Panel(series_6)
panel_6 = Panel(list_length_5)
relay = Relay([rotate.Geometry, rotate_2.Geometry])
brep_edges = BrepEdges(Brep=relay)  # -> Naked, flatten(Interior), NonManifold
custom_preview_2 = CustomPreview(Geometry=relay, Material=ColourSwatch(SwatchColor=RGB(101, 140, 119)))
list_item_3 = ListItem(List=rotate.Geometry, Index=Slider(0, range=0..10), Wrap=True)
curvepreview = CurvePreview(Curve=brep_edges.Interior, Width=Slider(3, range=0..5), Colour=ColourSwatch(SwatchColor=RGB(23, 38, 33)))
rotate_3 = Rotate(Geometry=simplify(xy_plane_3), Angle=simplify(degrees(series_4)), Plane=simplify(xy_plane_3))  # -> simplify(Geometry), Transform
rotate_4 = Rotate(Geometry=simplify(xy_plane_5), Angle=simplify(degrees(series_6)), Plane=simplify(xy_plane_5))  # -> Geometry, Transform
reverse_list = ReverseList(List=rotate_4.Geometry)
flip_matrix = FlipMatrix(Data=reverse_list)  # -> simplify(Data)
flip_matrix_2 = FlipMatrix(Data=rotate_3.Geometry)  # -> simplify(Data)
deconstruct_plane = DeconstructPlane(Plane=flip_matrix_2)  # -> Origin, XAxis, YAxis, ZAxis
deconstruct = Deconstruct(Point=deconstruct_plane.Origin)  # -> XComponent, YComponent, ZComponent
construct_point_2 = ConstructPoint(XCoordinate=deconstruct.XComponent, YCoordinate=deconstruct.YComponent, ZCoordinate=0)
deconstruct_plane_2 = DeconstructPlane(Plane=flip_matrix)  # -> Origin, XAxis, YAxis, ZAxis
deconstruct_2 = Deconstruct(Point=deconstruct_plane_2.Origin)  # -> XComponent, YComponent, ZComponent
construct_plane = ConstructPlane(Origin=construct_point_2, XAxis=deconstruct_plane.XAxis, YAxis=deconstruct_plane.YAxis)
construct_point_3 = ConstructPoint(XCoordinate=deconstruct_2.XComponent, YCoordinate=deconstruct_2.YComponent, ZCoordinate=0)
move_3 = Move(Geometry=construct_plane, Motion=unit_z)  # -> Geometry, Transform
construct_plane_2 = ConstructPlane(Origin=construct_point_3, XAxis=deconstruct_plane_2.XAxis, YAxis=deconstruct_plane_2.YAxis)
rotate_plane = RotatePlane(Plane=move_3.Geometry, Angle=0.7853981634)
flip_plane = FlipPlane(Plane=rotate_plane, FlipX=False, FlipY=False, FlipZ=False)  # -> Flipped, ResultBoolean
center_box = CenterBox(Base=rotate_plane, X=expr("0.5*x", xsize), Y=expr("0.5*x", ysize), Z=expr("0.5*x", zsize))
move_4 = Move(Geometry=construct_plane_2, Motion=unit_z_2)  # -> Geometry, Transform
rotate_plane_2 = RotatePlane(Plane=move_4.Geometry, Angle=0.7853981634)
merge_2 = Merge(Data1=rotate_plane, Data2=move_4.Geometry)  # -> flatten(Result)

wall = GhPythonScript(noPerRow=integer, planes=merge_2, surface=loft, options=wall_options)  # -> assembly, parts_geo; inputs noPerRow: Int32, planes: list of Plane, surface: Surface
# ---------- wall: Python ----------
import math
import os
import sys

import compas
from compas.geometry import Box
from compas.geometry import Frame
from compas.geometry import Vector, Point
from compas.geometry import Polyhedron
from compas.datastructures import Assembly
from compas.datastructures import Part

from compas.utilities import linspace
from compas_rhino.conversions import RhinoSurface

canvas = ghenv.Component.OnPingDocument()
folder = os.path.dirname(canvas.FilePath)
if folder not in sys.path:
    sys.path.append(folder)

# Default
xsize = options.xsize
ysize = options.ysize
zsize = options.zsize
xgap = options.xgap
zgap = options.zgap

#surface = RhinoSurface.from_geometry(surface).to_compas()

parts_geo = []

#wall_vertical_curve = surface.v_isocurve(0)
#wall_height = wall_vertical_curve.length()
#courses = int(math.ceil((wall_height / (zsize + zgap))))
courses = noPerRow


assembly = Assembly()
#half_brick = Box.from_diagonal([(-xsize / 4, -ysize / 2, 0), (xsize / 4, ysize / 2, -zsize)])
full_brick = Box.from_diagonal([(-xsize / 2, -ysize / 2, 0), (xsize / 2, ysize / 2, -zsize)])

#for ri, row in enumerate(linspace(0, 1, courses)):
#
#    _, u = wall_vertical_curve.rhino_curve.NormalizedLengthParameter(row)
#    
#    row_curve = surface.u_isocurve(u)
#    row_length = row_curve.length()
#
#    c = (row_length / (xsize + xgap))
#    col_count = int(math.ceil(c))
#    linspaced_vector = list(linspace(0, 1, col_count))
#    half_brick_offset = linspaced_vector[1] / 2
#    
#    for ci, l in enumerate(linspaced_vector):
#        if ri % 2:
#            l += half_brick_offset
#
#        if ci == 0 and ri % 2 == 0:
#            l += half_brick_offset / 2
#        if ci == col_count - 1 and ri % 2 == 0:
#            l -= half_brick_offset / 2
#
#        fits, col = row_curve.rhino_curve.NormalizedLengthParameter(l)
#        if not fits: break
#
#        point = row_curve.point_at(col)
#        xaxis = row_curve.tangent_at(col)
#        frame = Frame(point, xaxis, xaxis.cross(Vector.Zaxis()))
#
#        if ri % 2 == 0 and ci in (0, col_count - 1):
#            brick = half_brick.copy()
#        else:
#            brick = full_brick.copy()
#            
#        brick_shape = Polyhedron(*brick.to_vertices_and_faces(triangulated=True))
#        part = Part(
#            shape=brick_shape,
#            frame=frame,
#            course=ri,
#            n=ci,
#            xsize=brick.xsize,
#            ysize=brick.ysize,
#            zsize=brick.zsize,
#        )
#        assembly.add_part(part)
#        

course = 0
for i,plane in enumerate(planes):
    
    brick = full_brick.copy()
    
    p = plane.Origin
    point = Point(p.X, p.Y, p.Z)
    yaxis = Vector(plane.XAxis.X, plane.XAxis.Y, plane.XAxis.Z)
    xaxis = Vector(plane.YAxis.X, plane.YAxis.Y, plane.YAxis.Z)
    frame = Frame(point, xaxis, yaxis)
    
    
    ri = i//noPerRow
    ci = i%noPerRow
    
    brick_shape = Polyhedron(*brick.to_vertices_and_faces(triangulated=True))
    part = Part(
        shape=brick_shape,
        frame=frame,
        course=ri,
        n=ci,
        xsize=brick.xsize,
        ysize=brick.ysize,
        zsize=brick.zsize,
    )
    assembly.add_part(part)
    print ri, ci

# Assembly attributes
assembly.attributes['courses'] = ri

parts_geo = [part.geometry for part in assembly.parts()]
#
#if save:
#    compas.json_dump({'assembly': assembly}, os.path.join(folder, 'session.json'), pretty=True)
# ---------- end wall ----------
edges = GhPythonScript(assembly=wall.assembly)  # -> assembly
# ---------- edges: Python ----------
import math
import os

import compas
from compas.geometry import Box
from compas.geometry import Plane
from compas.geometry import Frame
from compas.geometry import Vector
from compas.geometry import Translation
from compas.geometry import Polygon
from compas.geometry import Projection
from compas.datastructures import Mesh
from separation_axis_theorem import separating_axis_theorem

canvas = ghenv.Component.OnPingDocument()
folder = os.path.dirname(canvas.FilePath)

projection = Projection.from_plane(Plane.worldXY())

for part in assembly.parts():
    # Store XY projection
    projected_mesh = Mesh.from_shape(part.geometry.transformed(projection))
    part.attributes['projection'] = Polygon(projected_mesh.face_coordinates(0))

    # Calculate place frame
    part.attributes['place_frame'] = part.frame.transformed(Translation.from_vector([0, 0, part.attributes['zsize']]))

# Connect assembly graph
last_course_parts = None
for c in range(assembly.attributes['courses'] + 1):
    course_parts = list(assembly.graph.nodes_where_predicate(lambda key, attr: attr['part'].attributes['course'] == c))

    if last_course_parts:
        for key in course_parts:
            part1 = assembly.find_by_key(key)
            polygon1 = part1.attributes['projection']

            for p2_key in last_course_parts:
                part2 = assembly.find_by_key(p2_key)
                polygon2 = part2.attributes['projection']
                are_connected = separating_axis_theorem(polygon1.points, polygon2.points)
                if are_connected:
                    assembly.add_connection(part2, part1)

    last_course_parts = course_parts
#
#if save:
#    compas.json_dump({'assembly': assembly}, os.path.join(folder, 'session.json'), pretty=True)
# ---------- end edges ----------
frames = GhPythonScript(assembly=edges, current_part_index=current_part_index)  # -> current_part, place_frame, sequence; inputs current_part_index: Int32
# ---------- frames: Python ----------
from helpers import traverse
from helpers import draw_parts
from helpers import draw_connections
from helpers import draw_parts_attribute
from helpers import get_assembly_sequence
from compas.artists import Artist


a = []
a += draw_parts_attribute(assembly, 'place_frame')

top_course = assembly.attributes["courses"]
sequence = get_assembly_sequence(assembly, top_course)
#sequence = range(182)

for i in range(current_part_index):
    part = assembly.find_by_key(sequence[i])
    if (current_part_index-1) == i:
        place_frame = part.attributes['place_frame']
        current_part = part
# ---------- end frames ----------
viz = GhPythonScript(assembly=edges)  # -> out, a
# ---------- viz: Python ----------
import compas_ghpython
from compas.artists import Artist

def draw_connections(assembly):
    lines = []

    for u, v in assembly.connections():
        u = assembly.find_by_key(u)
        v = assembly.find_by_key(v)
        lines.append(
            {
                "start": list(u.frame.point),
                "end": list(v.frame.point),
            }
        )
    return compas_ghpython.draw_lines(lines)

a = []
a += draw_connections(assembly)
# ---------- end viz ----------
draw = Draw(cg=frames.place_frame)  # -> rg
#   port cg: The COMPAS geometry or datastructure to be drawn.
#   port rg: The Rhino geometry object.
# ---------- draw: Python ----------
"""
Draws COMPAS geometry in Grasshopper.
"""
from ghpythonlib.componentbase import executingcomponent as component

from compas.artists import Artist


class CompasToRhinoGeometry(component):
    def RunScript(self, cg):
        if not cg:
            return None

        return Artist(cg).draw()
# ---------- end draw ----------
target_plane = Data(frames.place_frame)
assembly = Data(edges)

assembly_2 = Data(assembly)
current_part_index_3 = Data(current_part_index_2)
part = GhPythonScript(assembly=assembly_2, current_part_index=current_part_index_3)  # -> part, geo
# ---------- part: Python ----------
from helpers import traverse
from helpers import draw_parts
from helpers import draw_connections
from helpers import draw_parts_attribute
from helpers import get_assembly_sequence
from compas.artists import Artist


top_course = assembly.attributes["courses"]
sequence = get_assembly_sequence(assembly, top_course)

if current_part_index:
    current_part_index = int(current_part_index)
    part = assembly.find_by_key(sequence[current_part_index])
    geo = Artist(part.geometry).draw()
# ---------- end part ----------
plan_trajectories = GhPythonScript(robot=robot_6, assembly=assembly_2, part=part.part, compute=boolean_toggle)  # -> pick_trajectory, pick_trajectory_frames, place_trajectory, place_trajectory_frames, move_trajectory, move_trajectory_frames; inputs compute: Boolean
# ---------- plan_trajectories: Python ----------
"""
Calculate pickup trajectory of a part.
"""
import math
from ghpythonlib.componentbase import executingcomponent as component
from scriptcontext import sticky as st

from compas.artists import Artist
from compas.geometry import Frame
from compas.geometry import Transformation
from compas_rhino.conversions import RhinoPlane
from compas_fab.ghpython.components import create_id
from compas_fab.robots import AttachedCollisionMesh
from compas_fab.robots import CollisionMesh
from compas_fab.robots import PlanningScene

from helpers import get_assembly_sequence

class PlanPartPickupTrajectory(component):
    def RunScript(self, robot, group, assembly, part, planner_id, compute):
        self.Message = ""

        if not part:
            self.Message = "No part selected"
            return

        approach_pick_config = part.attributes.get("approach_pick_config")
        pick_config = part.attributes.get("pick_config")
        approach_place_config = part.attributes.get("approach_place_config")
        place_config = part.attributes.get("place_config")
        
        pick_trajectory = None
        place_trajectory = None
        move_trajectory = None

        pick_trajectory_frames = []
        place_trajectory_frames = []
        move_trajectory_frames = []


        top_course = assembly.attributes["courses"]
        sequence = get_assembly_sequence(assembly, top_course)

        if not approach_pick_config or not pick_config:
            self.Message = "No approach & pick configs defined"
            return pick_trajectory, pick_trajectory_frames, place_trajectory, place_trajectory_frames, move_trajectory, move_trajectory_frames

        # Clean scene
        if compute and robot and robot.client and robot.client.is_connected:
            scene = PlanningScene(robot)
            scene.remove_collision_mesh("parts")

            for key in sequence:
                if key == part.key: break
                part_mesh = assembly.find_by_key(key).to_mesh()
                part_cm = CollisionMesh(part_mesh, "parts")
                scene.append_collision_mesh(part_cm)

        # Compute PICK trajectory
        if compute and robot and robot.client and robot.client.is_connected:
            max_step = 0.01
            frames = [
                       robot.forward_kinematics(c, group, options=dict(solver='model'))
                       for c in (approach_pick_config, pick_config)
                     ]

            trajectory = robot.plan_cartesian_motion(frames,
                                                     start_configuration=approach_pick_config,
                                                     group=group,
                                                     options=dict(
                                                         max_step=max_step,
                                                     ))
            if trajectory.fraction < 1:
                pass 
                print("Incomplete pick cartesian trajectory found. Only {:.1f}% of the trajectory could be planned".format(trajectory.fraction * 100))
                # raise Exception("Incomplete cartesian trajectory found. Only {:.1f}% of the trajectory could be planned".format(trajectory.fraction * 100))

            # Only assign if fraction is full
            part.attributes["pick_trajectory"] = trajectory

        pick_trajectory = part.attributes.get("pick_trajectory")

        if pick_trajectory:
            for c in pick_trajectory.points:
                frame = robot.forward_kinematics(c, group, options=dict(solver='model'))
                pick_trajectory_frames.append(Artist(frame).draw())

        if not approach_place_config or not place_config:
            self.Message = "No approach & place configs defined"
            return pick_trajectory, pick_trajectory_frames, place_trajectory, place_trajectory_frames, move_trajectory, move_trajectory_frames

        # Compute PLACE trajectory
        if compute and robot and robot.client and robot.client.is_connected:
            max_step = 0.01
            frames = [
                       robot.forward_kinematics(c, group, options=dict(solver='model'))
                       for c in (approach_place_config, place_config)
                     ]

            # TODO: Add brick
            # attached_collision_meshes = []
            trajectory = robot.plan_cartesian_motion(frames,
                                                     start_configuration=approach_place_config,
                                                     group=group,
                                                     options=dict(
                                                         max_step=max_step,
#                                                         attached_collision_meshes=attached_collision_meshes
                                                     ))
            if trajectory.fraction < 1:
                print("Incomplete cartesian trajectory found. Only {:.1f}% of the trajectory could be planned".format(trajectory.fraction * 100))
                pass #raise Exception("Incomplete cartesian trajectory found. Only {:.1f}% of the trajectory could be planned".format(trajectory.fraction * 100))

            # Only assign if fraction is full
            part.attributes["place_trajectory"] = trajectory

        place_trajectory = part.attributes.get("place_trajectory")

        if place_trajectory:
            for c in place_trajectory.points:
                frame = robot.forward_kinematics(c, group, options=dict(solver='model'))
                place_trajectory_frames.append(Artist(frame).draw())

        # Compute MOVE trajectory
        if compute and robot and robot.client and robot.client.is_connected:
            planner_id = planner_id or 'TRRT'

            # TODO: Add brick
            # attached_collision_meshes = []

            tolerance_above = self._generate_default_tolerances(robot.get_configurable_joints(group))
            tolerance_below = self._generate_default_tolerances(robot.get_configurable_joints(group))
            goal_constraints = robot.constraints_from_configuration(
                configuration=approach_place_config,
                tolerances_above=tolerance_above,
                tolerances_below=tolerance_below,
                group=group
            )

            part.attributes["move_trajectory"] = robot.plan_motion(goal_constraints,
                                                                   start_configuration=approach_pick_config,
                                                                   group=group,
                                                                   options=dict(
                                                                       planner_id=planner_id,
#                                                                       attached_collision_meshes=attached_collision_meshes
                                                                   ))

        move_trajectory = part.attributes.get("move_trajectory")

        if move_trajectory:
            for c in move_trajectory.points:
                frame = robot.forward_kinematics(c, group, options=dict(solver='model'))
                move_trajectory_frames.append(Artist(frame).draw())

        if pick_trajectory and place_trajectory and move_trajectory:
            self.Message = "Found all trajectories ({} points)".format(len(pick_trajectory.points) + len(place_trajectory.points) + len(move_trajectory.points))

        return pick_trajectory, pick_trajectory_frames, place_trajectory, place_trajectory_frames, move_trajectory, move_trajectory_frames

    def _generate_default_tolerances(self, joints):
        DEFAULT_TOLERANCE_METERS = .001
        DEFAULT_TOLERANCE_RADIANS = math.radians(1)

        return [
            DEFAULT_TOLERANCE_METERS if j.is_scalable()
            else DEFAULT_TOLERANCE_RADIANS
            for j in joints
        ]
# ---------- end plan_trajectories ----------
merge_3 = GhPythonScript(
    pick_trajectory=plan_trajectories.pick_trajectory,
    place_trajectory=plan_trajectories.place_trajectory,
    move_trajectory=plan_trajectories.move_trajectory)  # -> trajectory
# ---------- merge_3: Python ----------
if pick_trajectory and move_trajectory and place_trajectory:
    trajectory = pick_trajectory.points + \
                 list(reversed(pick_trajectory.points)) + \
                 move_trajectory.points + \
                 place_trajectory.points + \
                 list(reversed(place_trajectory.points)) + \
                 list(reversed(move_trajectory.points))
# ---------- end merge_3 ----------
move_trajectory = Data(plan_trajectories.move_trajectory)
place_trajectory = Data(plan_trajectories.place_trajectory)
pick_trajectory = Data(plan_trajectories.pick_trajectory)
trajectory = Data(merge_3)

assembly_3 = Data(assembly)
current_part_index_4 = Data(current_part_index_2)
part_2 = GhPythonScript(assembly=assembly_3, current_part_index=current_part_index_4)  # -> part, geo; same code as part
plan_pickup = GhPythonScript(
    robot=robot_5,
    start_configuration=ghpython_script.x,
    pick_frame=pickup_plane_2,
    part=part_2.part,
    approach_distance=0.1,
    update=boolean_toggle)  # -> pick_config, approach_pick_config, pick_geo
# ---------- plan_pickup: Python ----------
"""
Calculate pickup of a part.
"""
from ghpythonlib.componentbase import executingcomponent as component
from scriptcontext import sticky as st

from compas.artists import Artist
from compas.geometry import Frame
from compas.geometry import Transformation
from compas_rhino.conversions import RhinoPlane
from compas_fab.ghpython.components import create_id
from compas_fab.robots import PlanningScene

class PickPart(component):
    def RunScript(self, robot, group, start_configuration, pick_frame, part, approach_distance, update):
        self.Message = ""

        pick_config = None
        approach_pick_config = None
        pick_trajectory = None
        pick_geo = None

        if pick_frame:
            pick_frame = RhinoPlane.from_geometry(pick_frame).to_compas_frame()

        # Adjust pick frame based on the grasp of the current part
        if part:
            if "place_frame" not in part.attributes:
                raise Exception("Part is missing the place_frame attribute")

            pick_part = part.copy()
            grasp_transform = Transformation.from_frame_to_frame(part.frame, part.attributes["place_frame"])
            pick_transform = Transformation.from_frame(pick_frame) * grasp_transform
            pick_frame_with_grasp = Frame.from_transformation(pick_transform)
            pick_part.frame = pick_frame.copy()
            pick_frame.transform(grasp_transform)

            pick_geo = [Artist(pick_part.geometry).draw()]

        approach_pick_frame = pick_frame.copy()
        if approach_distance > 0:
            approach_pick_frame.point.z += approach_distance

        if part:
            pick_config = part.attributes.get("pick_config")
            approach_pick_config = part.attributes.get("approach_pick_config")
        
        if (update or not pick_config or not approach_pick_config) and robot and robot.client and robot.client.is_connected:
            scene = PlanningScene(robot)
            scene.remove_collision_mesh("parts")
            
            pick_config = robot.inverse_kinematics(pick_frame, start_configuration, group)
            approach_pick_config = robot.inverse_kinematics(approach_pick_frame, pick_config, group)

            if part:
                part.attributes["pick_config"] = pick_config
                part.attributes["approach_pick_config"] = approach_pick_config
        
        self.Message = "Found pick up configurations\nusing {:.2f}m approach distance".format(approach_distance)
        return pick_config, approach_pick_config, pick_geo
# ---------- end plan_pickup ----------
plan_place = GhPythonScript(
    robot=robot_5,
    approach_pick_config=plan_pickup.approach_pick_config,
    part=part_2.part,
    approach_distance=0.1,
    update=boolean_toggle)  # -> place_config, approach_place_config, placed_part_geo
# ---------- plan_place: Python ----------
"""
Calculate placement of a part.
"""
from ghpythonlib.componentbase import executingcomponent as component
from scriptcontext import sticky as st

from compas.artists import Artist
from compas.geometry import Frame
from compas.geometry import Transformation
from compas_rhino.conversions import RhinoPlane
from compas_fab.ghpython.components import create_id
from compas_fab.robots import PlanningScene

class PlacePart(component):
    def RunScript(self, robot, group, approach_pick_config, part, approach_distance, update):
        self.Message = ""
        if not part:
            raise Exception("No part selected")

        place_config = part.attributes.get("place_config")
        approach_place_config = part.attributes.get("approach_place_config")
        placed_part_geo = [Artist(part.geometry).draw()]
        
        if (update or not place_config or not approach_place_config) and robot and robot.client and robot.client.is_connected:
            scene = PlanningScene(robot)
            scene.remove_collision_mesh("parts")

            place_frame = part.attributes["place_frame"].copy()
            approach_place_frame = place_frame.copy()
            if approach_distance > 0:
                approach_place_frame.point.z += approach_distance
            place_config = robot.inverse_kinematics(place_frame, approach_pick_config, group)
            approach_place_config = robot.inverse_kinematics(approach_place_frame, place_config, group)

            part.attributes["place_config"] = place_config
            part.attributes["approach_place_config"] = approach_place_config

        self.Message = "Found place configurations\nusing {:.2f}m approach distance".format(approach_distance)
        return place_config, approach_place_config, placed_part_geo
# ---------- end plan_place ----------
approach_pickup_config = Data(plan_pickup.approach_pick_config)
approach_place_config = Data(plan_place.approach_place_config)
pickup_config = Data(plan_pickup.pick_config)
place_config = Data(plan_place.place_config)

trajectory_visualize = TrajectoryVisualize(robot=robot, trajectory=plan_trajectories.pick_trajectory)  # -> start_configuration, configurations, fraction, time, planes, P, V, A
#   port group: The planning group for which this trajectory was planned.
#   port trajectory: The calculated trajectory.
#   port start_configuration: The start configuration of the trajectory.
#   port configurations: The full configurations along the trajectory.
#   port fraction: Indicates the fraction of requested trajectory that was calculated, e.g. 1 means the full trajectory was found.
#   port time: The time which is needed to execute that trajectory at full speed.
#   port planes: The planes of the robot's end-effector.
#   port P: The positions along the trajectory
#   port V: The velocities along the trajectory
#   port A: The accelerations along the trajectory
# ---------- trajectory_visualize: Python ----------
"""
Visualizes a trajectory.

COMPAS FAB v0.27.0
"""
from compas_ghpython import draw_frame
from compas_ghpython import list_to_ghtree
from ghpythonlib.componentbase import executingcomponent as component


class TrajectoryVisualize(component):
    def RunScript(self, robot, group, trajectory):
        start_configuration = None
        configurations = []
        fraction = 0.
        time = 0.

        planes = []
        positions = []
        velocities = []
        accelerations = []

        if robot and trajectory:
            group = group or robot.main_group_name

            for c in trajectory.points:
                configurations.append(robot.merge_group_with_full_configuration(c, trajectory.start_configuration, group))
                frame = robot.forward_kinematics(c, group, options=dict(solver='model'))
                planes.append(draw_frame(frame))
                positions.append(c.positions)
                velocities.append(c.velocities)
                accelerations.append(c.accelerations)

            start_configuration = trajectory.start_configuration
            fraction = trajectory.fraction
            time = trajectory.time_from_start

        P = list_to_ghtree(list(zip(*positions)))
        V = list_to_ghtree(list(zip(*velocities)))
        A = list_to_ghtree(list(zip(*accelerations)))

        # return outputs if you have them; here I try it for you:
        return (start_configuration, configurations, fraction, time, planes, P, V, A)
# ---------- end trajectory_visualize ----------
list_item_4 = ListItem(List=trajectory_visualize.configurations, Index=Slider(11, range=0..20), Wrap=True)
robot_visualize = RobotVisualize(robot=robot, configuration=list_item_4)  # -> visual, collision, collision_meshes, attached_meshes, frames, base_frame, ee_frame; inputs show_visual: Boolean, show_collision: Boolean, show_frames: Boolean, show_base_frame: Boolean, show_end_effector_frame: Boolean, show_cm: Boolean, show_acm: Boolean
#   port group: The planning group used for end-effector and base visualization.
#   port configuration: The robot's full configuration.
#   port show_visual: Whether or not to show the robot's visual meshes.
#   port show_collision: Whether or not to show the robot's collision meshes.
#   port show_frames: Whether or not to show the robot's joint frames.
#   port show_base_frame: Whether or not to show the robot's base frame.
#   port show_end_effector_frame: Whether or not to show the robot's end-effector frame.
#   port show_cm: Whether or not to show the collision meshes (if any).
#   port show_acm: Whether or not to show the attached collision meshes (if any).
#   port visual: Rhino meshes of the robot's visual geometry (if any).
#   port collision: Rhino meshes of the robot's collision geometry (if any).
#   port collision_meshes: Rhino meshes of the scene's collision meshes (if any).
#   port attached_meshes: Rhino meshes of the scene's attached collision meshes (if any).
#   port frames: The robot's joint frames as Rhino planes (if any).
#   port base_frame: The robot's base frame as a Rhino plane (if any).
#   port ee_frame: The robot's end-effector frame as a Rhino plane (if any).
# ---------- robot_visualize: Python ----------
"""
Visualizes the robot.

COMPAS FAB v0.27.0
"""
from compas.artists import Artist
from compas.geometry import Frame
from compas.geometry import Transformation
from compas_fab.robots import PlanningScene
from ghpythonlib.componentbase import executingcomponent as component


class RobotVisualize(component):
    def RunScript(
        self,
        robot,
        group,
        configuration,
        show_visual,
        show_collision,
        show_frames,
        show_base_frame,
        show_end_effector_frame,
        show_cm,
        show_acm,
    ):

        visual = None
        collision = None
        collision_meshes = None
        attached_meshes = None
        frames = None
        base_frame = None
        ee_frame = None

        if robot:
            show_visual = True if show_visual is None else show_visual
            show_cm = True if show_cm is None else show_cm
            show_acm = True if show_acm is None else show_acm
            configuration = configuration or robot.zero_configuration()

            robot.update(configuration, visual=show_visual, collision=show_collision)
            compas_frames = robot.transformed_frames(configuration, group)

            if show_visual:
                visual = robot.artist.draw_visual()

            if show_collision:
                collision = robot.artist.draw_collision()

            if show_base_frame:
                base_compas_frame = compas_frames[0]
                artist = Artist(base_compas_frame)
                base_frame = artist.draw()

            if show_end_effector_frame:
                ee_compas_frame = robot.forward_kinematics(
                    configuration, group, options=dict(solver="model")
                )
                artist = Artist(ee_compas_frame)
                ee_frame = artist.draw()

            if show_frames:
                frames = []
                for compas_frame in compas_frames[1:]:
                    artist = Artist(compas_frame)
                    frame = artist.draw()
                    frames.append(frame)

            if show_cm or show_acm:
                scene = PlanningScene(robot)
                scene = robot.client.get_planning_scene()

                collision_meshes = []
                attached_meshes = []

                if show_cm:
                    for co in scene.world.collision_objects:
                        header = co.header
                        frame_id = header.frame_id
                        cms = co.to_collision_meshes()

                        for cm in cms:
                            if cm.frame != Frame.worldXY():
                                t = Transformation.from_frame(cm.frame)
                                mesh = cm.mesh.transformed(t)
                            else:
                                mesh = cm.mesh

                            collision_meshes.append(Artist(mesh).draw())

                if show_acm:
                    for aco in scene.robot_state.attached_collision_objects:
                        for acm in aco.to_attached_collision_meshes():
                            frame_id = aco.object["header"]["frame_id"]
                            frame = robot.forward_kinematics(
                                configuration, options=dict(link=frame_id)
                            )
                            t = Transformation.from_frame(frame)

                            # Local CM frame
                            if (
                                acm.collision_mesh.frame
                                and acm.collision_mesh.frame != Frame.worldXY()
                            ):
                                t = t * Transformation.from_frame(
                                    acm.collision_mesh.frame
                                )

                            mesh = acm.collision_mesh.mesh.transformed(t)

                            attached_meshes.append(Artist(mesh).draw())

        return (
            visual,
            collision,
            collision_meshes,
            attached_meshes,
            frames,
            base_frame,
            ee_frame,
        )
# ---------- end robot_visualize ----------
list_item_5 = ListItem(List=viz.a, Index=current_part_index, Wrap=True)

# ----
# Assembly loading/saving
panel_7 = Panel("assembly-data.json")
assembly_4 = Data(assembly)
formatted = BooleanToggle(True)
save = GhPythonScript(assembly=assembly_4, filename=panel_7, pretty=formatted, save=Button())  # -> out, path
# ---------- save: Python ----------
import os

dirname = os.path.dirname(ghenv.Component.OnPingDocument().FilePath)
if "\\" in filename or "/" in filename:
    raise Exception("Invalid name, don't enter a full path, only a file name. Eg. assembly.json")

path = os.path.join(dirname, filename)

if assembly and save:
    assembly.to_json(path, pretty=pretty)
# ---------- end save ----------
load = GhPythonScript(filename=panel_7, load=Button())  # -> assembly
# ---------- load: Python ----------
import os
from scriptcontext import sticky

from compas.datastructures import Assembly

dirname = os.path.dirname(ghenv.Component.OnPingDocument().FilePath)
if "\\" in filename or "/" in filename:
    raise Exception("Invalid name, don't enter a full path, only a file name. Eg. assembly.json")

path = os.path.join(dirname, filename)
key = "assembly_key_{}".format(path)

if load:
    sticky[key] = Assembly.from_json(path)

assembly = sticky.get(key)
# ---------- end load ----------
assembly_5 = Data(load)

# ----
# Robot control
robot_7 = Data(robot_4)
speed = Slider(300, range=50..1000)
pick_trajectory_2 = Data(pick_trajectory)
move_trajectory_2 = Data(move_trajectory)
approach_pickup_config_2 = Data(approach_pickup_config)
pickup_config_2 = Data(pickup_config)
approach_place_config_2 = Data(approach_place_config)
trajectory_2 = Data(trajectory)
place_trajectory_2 = Data(place_trajectory)
assembly_6 = Data(assembly)
current_part_index_5 = Data(current_part_index_2)
place_config_2 = Data(place_config)
ros = GhPythonScript(robot=robot_7)  # -> ros
# ---------- ros: Python ----------
if robot and robot.client:
    ros = robot.client
# ---------- end ros ----------
part_3 = GhPythonScript(assembly=assembly_6, current_part_index=current_part_index_5)  # -> part, geo; same code as part
abb = GhPythonScript(ros_client=ros)  # -> abb
# ---------- abb: Python ----------
import compas_rrc as rrc

if ros_client and ros_client.is_connected:
    abb = rrc.AbbClient(ros_client)
# ---------- end abb ----------
go = Button()
go_2 = Button()
go_3 = Button()
go_4 = Button()
current = GhPythonScript(robot=robot_7, abb=abb, go=go_2)  # -> config, frame
# ---------- current: Python ----------
import Grasshopper
import System
import Rhino
import scriptcontext as sc

from ghpythonlib.componentbase import executingcomponent as component

from compas_fab.robots import to_radians
from compas_fab.ghpython.components import create_id

import compas_rrc as rrc

class MyComponent(component):
    
    def RunScript(self, robot, abb, go):
        key = create_id(self, 'last_config')
        frame = None

        if robot and abb and abb.ros.is_connected and go:
            joints, _ = abb.send_and_wait(rrc.GetJoints(), timeout=5)
            config = robot.zero_configuration()
            config.joint_values = to_radians(joints)
            
            sc.sticky[key] = config
            print(config)
        config = sc.sticky.get(key)

        if robot and config:
            frame = robot.forward_kinematics(config, options=dict(solver='model'))

        return (config, frame)
# ---------- end current ----------
send_trajectory = GhPythonScript(robot=robot_7, abb=abb, speed=speed, trajectory=trajectory_2, go=go_3)  # inputs trajectory: list
# ---------- send_trajectory: Python ----------
import compas_rrc as rrc
from compas_fab.robots import to_degrees

if robot and abb and abb.ros.is_connected and go:
    abb.send(rrc.PrintText("Sending {} points. Press play to move".format(len(trajectory))))
    abb.send(rrc.Stop())

    for i in range(len(trajectory)):
        c = trajectory[i]
        joints = to_degrees(c.joint_values)
        speed = speed or 500
        if i < len(trajectory) - 1:
            zone = rrc.Zone.Z10
        else:
            zone = rrc.Zone.FINE
            
        abb.send(rrc.MoveToJoints(joints, ext_axes=[], speed=speed, zone=zone))
# ---------- end send_trajectory ----------
send_pick_n_place = GhPythonScript(
    robot=robot_7,
    abb=abb,
    speed=speed,
    pick_trajectory=pick_trajectory_2,
    place_trajectory=place_trajectory_2,
    move_trajectory=move_trajectory_2,
    io_signal="ABB_Scalable_IO_0_DO16",
    go=go)
# ---------- send_pick_n_place: Python ----------
import compas_rrc as rrc
from compas_fab.robots import to_degrees

def send_trajectory(abb, robot, speed, points, last_point_fine=True):
    for i in range(len(points)):
        c = points[i]
        joints = to_degrees(c.joint_values)
        if i < len(points) - 1:
            zone = rrc.Zone.Z10
        else:
            zone = rrc.Zone.FINE if last_point_fine else rrc.Zone.Z10

        abb.send(rrc.MoveToJoints(joints, ext_axes=[], speed=speed, zone=zone))
    
if robot and abb and abb.ros.is_connected and go:
    total_points = len(pick_trajectory.points) * 2 + len(move_trajectory.points) * 2 + len(place_trajectory.points) * 2

    abb.send(rrc.PrintText("Sending {} PnP points. Press play to move".format(total_points)))
    abb.send(rrc.Stop())

    speed = speed or 500
    send_trajectory(abb, robot, speed, pick_trajectory.points)
    abb.send(rrc.SetDigital(io_signal, 1))
    abb.send(rrc.WaitTime(2))
    send_trajectory(abb, robot, speed, list(reversed(pick_trajectory.points)), last_point_fine=False)
    send_trajectory(abb, robot, speed, move_trajectory.points, last_point_fine=False)
    send_trajectory(abb, robot, speed, place_trajectory.points)
    abb.send(rrc.SetDigital(io_signal, 0))
    abb.send(rrc.WaitTime(2))
    send_trajectory(abb, robot, speed, list(reversed(place_trajectory.points)), last_point_fine=False)
    send_trajectory(abb, robot, speed, list(reversed(move_trajectory.points)))
# ---------- end send_pick_n_place ----------
plan_and_move = GhPythonScript(
    robot=robot_7,
    abb=abb,
    speed=speed,
    assembly=assembly_6,
    part=part_3.part,
    target_config=approach_pickup_config_2,
    go=go_4)
# ---------- plan_and_move: Python ----------
import compas_rrc as rrc
from compas_fab.robots import CollisionMesh
from compas_fab.robots import PlanningScene
from compas_fab.robots import to_degrees
from compas_fab.robots import to_radians

from helpers import get_assembly_sequence

if robot and abb and abb.ros.is_connected and go:
    joints, _ = abb.send_and_wait(rrc.GetJoints(), timeout=5)
    current_config = robot.zero_configuration()
    current_config.joint_values = to_radians(joints)
    print current_config

    top_course = assembly.attributes["courses"]
    sequence = get_assembly_sequence(assembly, top_course)

    scene = PlanningScene(robot)
    scene.remove_collision_mesh("parts")

    for key in sequence:
        if key == part.key: break
        part_mesh = assembly.find_by_key(key).to_mesh()
        part_cm = CollisionMesh(part_mesh, "parts")
        scene.append_collision_mesh(part_cm)


    goal_constraints = robot.constraints_from_configuration(
        configuration=target_config,
        tolerances_above=[0.1] * 6,
        tolerances_below=[0.1] * 6,
    )
    trajectory = robot.plan_motion(goal_constraints,
                                   start_configuration=current_config)
    
    abb.send(rrc.PrintText("Sending {} points. Press play to move".format(len(trajectory.points))))
    abb.send(rrc.Stop())

    for i in range(len(trajectory.points)):
        c = trajectory.points[i]
        joints = to_degrees(c.joint_values)
        speed = speed or 500
        if i < len(trajectory.points) - 1:
            zone = rrc.Zone.Z10
        else:
            zone = rrc.Zone.FINE
            
        abb.send(rrc.MoveToJoints(joints, ext_axes=[], speed=speed, zone=zone))
# ---------- end plan_and_move ----------
draw_2 = Draw(cg=current.frame)  # -> rg; same code as draw
current_config = Data(current.config)
current_frame = Data(current.frame)

# ----
# Visualization
# Assembly visualization
list = ValueList({"Approach pickup config": 0, "Pickup config": 1, "Approach place config": 2, "Place config": 3, "Trajectory": 4}, selected="Place config")
robot_8 = Data(robot_4)
approach_pickup_config_3 = Data(approach_pickup_config)
pickup_config_3 = Data(pickup_config)
approach_place_config_3 = Data(approach_place_config)
place_config_3 = Data(place_config)
current_part_index_6 = Data(current_part_index_2)
trajectory_3 = Data(trajectory)
assembly_7 = Data(assembly)
filter = StreamFilter(
    Gate=list,
    Stream0=approach_pickup_config_3,
    Stream1=pickup_config_3,
    Stream2=approach_place_config_3,
    Stream3=place_config_3,
    Stream4=trajectory_3)
item = ListItem(List=filter, Index=Slider(0, range=0..200), Wrap=True)
robot_visualize_2 = RobotVisualize(robot=robot_8, configuration=item)  # -> visual, collision, collision_meshes, attached_meshes, frames, base_frame, ee_frame; inputs show_visual: Boolean, show_collision: Boolean, show_frames: Boolean, show_base_frame: Boolean, show_end_effector_frame: Boolean, show_cm: Boolean, show_acm: Boolean
#   port group: The planning group used for end-effector and base visualization.
#   port configuration: The robot's full configuration.
#   port show_visual: Whether or not to show the robot's visual meshes.
#   port show_collision: Whether or not to show the robot's collision meshes.
#   port show_frames: Whether or not to show the robot's joint frames.
#   port show_base_frame: Whether or not to show the robot's base frame.
#   port show_end_effector_frame: Whether or not to show the robot's end-effector frame.
#   port show_cm: Whether or not to show the collision meshes (if any).
#   port show_acm: Whether or not to show the attached collision meshes (if any).
#   port visual: Rhino meshes of the robot's visual geometry (if any).
#   port collision: Rhino meshes of the robot's collision geometry (if any).
#   port collision_meshes: Rhino meshes of the scene's collision meshes (if any).
#   port attached_meshes: Rhino meshes of the scene's attached collision meshes (if any).
#   port frames: The robot's joint frames as Rhino planes (if any).
#   port base_frame: The robot's base frame as a Rhino plane (if any).
#   port ee_frame: The robot's end-effector frame as a Rhino plane (if any).
# ---------- robot_visualize_2: Python ----------
"""
Visualizes the robot.

COMPAS FAB v0.27.0
"""
import time

from compas.artists import Artist
from compas.geometry import Frame
from compas.geometry import Transformation
from ghpythonlib.componentbase import executingcomponent as component
from scriptcontext import sticky as st

from compas_fab.ghpython.components import create_id
from compas_fab.robots import PlanningScene


class RobotVisualize(component):
    def RunScript(
        self,
        robot,
        group,
        configuration,
        show_visual,
        show_collision,
        show_frames,
        show_base_frame,
        show_end_effector_frame,
        show_cm,
        show_acm,
    ):

        visual = None
        collision = None
        collision_meshes = None
        attached_meshes = None
        frames = None
        base_frame = None
        ee_frame = None

        if robot:
            show_visual = True if show_visual is None else show_visual
            show_cm = True if show_cm is None else show_cm
            show_acm = True if show_acm is None else show_acm
            configuration = configuration or robot.zero_configuration()

            robot.update(configuration, visual=show_visual, collision=show_collision)
            compas_frames = robot.transformed_frames(configuration, group)

            if show_visual:
                visual = robot.artist.draw_visual()

            if show_collision:
                collision = robot.artist.draw_collision()

            if show_base_frame:
                base_compas_frame = compas_frames[0]
                artist = Artist(base_compas_frame)
                base_frame = artist.draw()

            if show_end_effector_frame:
                ee_compas_frame = robot.forward_kinematics(configuration, group, options=dict(solver="model"))
                artist = Artist(ee_compas_frame)
                ee_frame = artist.draw()

            if show_frames:
                frames = []
                for compas_frame in compas_frames[1:]:
                    artist = Artist(compas_frame)
                    frame = artist.draw()
                    frames.append(frame)

            cached_scene_key = create_id(self, "cached_scene")

            if show_cm or show_acm:
                cached_scene = st.get(cached_scene_key)
                if not cached_scene:
                    cached_scene = {"time": 0}

                # expire cache if the component has not been executed in the last 2 seconds
                # this allows to slide through a list of configurations
                # without triggering refreshes of the scene in the middle of it
                if time.time() - cached_scene["time"] > 2:
                    update_scene = True
                else:
                    update_scene = False

                if update_scene:
                    scene = PlanningScene(robot)
                    scene = robot.client.get_planning_scene()

                if update_scene and show_cm:
                    collision_meshes = []

                    for co in scene.world.collision_objects:
                        header = co.header
                        frame_id = header.frame_id
                        cms = co.to_collision_meshes()

                        for cm in cms:
                            if cm.frame != Frame.worldXY():
                                t = Transformation.from_frame(cm.frame)
                                mesh = cm.mesh.transformed(t)
                            else:
                                mesh = cm.mesh

                            collision_meshes.append(Artist(mesh).draw())

                        cached_scene["cm"] = collision_meshes

                collision_meshes = cached_scene.get("cm", [])

                if update_scene and show_acm:
                    attached_meshes = []

                    for aco in scene.robot_state.attached_collision_objects:
                        for acm in aco.to_attached_collision_meshes():
                            frame_id = aco.object["header"]["frame_id"]
                            frame = robot.forward_kinematics(configuration, options=dict(link=frame_id))
                            t = Transformation.from_frame(frame)

                            # Local CM frame
                            if acm.collision_mesh.frame and acm.collision_mesh.frame != Frame.worldXY():
                                t = t * Transformation.from_frame(acm.collision_mesh.frame)

                            mesh = acm.collision_mesh.mesh.transformed(t)

                            attached_meshes.append(Artist(mesh).draw())

                    cached_scene["acm"] = attached_meshes

                attached_meshes = cached_scene.get("acm", [])

                cached_scene["time"] = time.time()
                st[cached_scene_key] = cached_scene

        return (
            visual,
            collision,
            collision_meshes,
            attached_meshes,
            frames,
            base_frame,
            ee_frame,
        )
# ---------- end robot_visualize_2 ----------
assembly_8 = GhPythonScript(assembly=assembly_7, current_part_index=current_part_index_6)  # -> current_part, place_frame, a; inputs current_part_index: Int32
# ---------- assembly_8: Python ----------
from helpers import traverse
from helpers import draw_parts
from helpers import draw_connections
from helpers import draw_parts_attribute
from helpers import get_assembly_sequence
from compas.artists import Artist


a = []
a = draw_parts(assembly)
a += draw_connections(assembly)
a += draw_parts_attribute(assembly, 'place_frame')

top_course = assembly.attributes["courses"]
sequence = get_assembly_sequence(assembly, top_course)

for i in range(current_part_index):
    part = assembly.find_by_key(sequence[i])
    if (current_part_index-1) == i:
        place_frame = part.attributes['place_frame']
        current_part = part

    a += [Artist(part.geometry).draw()]
# ---------- end assembly_8 ----------

ghpython_script_2 = GhPythonScript(config=current_config)  # -> out, a
# ---------- ghpython_script_2: Python ----------
a = config.joint_values
# ---------- end ghpython_script_2 ----------
degrees = Degrees(Radians=ghpython_script_2.a)
panel_8 = Panel(current_config)
panel_9 = Panel(degrees)
move_5 = Move(Geometry=rotate_plane_2, Motion=unit_z_3)  # -> Geometry, Transform
center_box_2 = CenterBox(Base=move_5.Geometry, X=expr("0.5*x", xsize_2), Y=expr("0.5*x", zsize_2), Z=expr("0.5*x", ysize_2))
list_item_6 = ListItem(List=merge_2, Index=Slider(122, range=0..140), Wrap=True)

# ==== cluster Cluster
curve_a = ClusterInput()
curve_b = ClusterInput()
ruled_surface = RuledSurface(CurveA=curve_a, CurveB=curve_b)
u_count = ClusterInput()
v_count = ClusterInput()
surface = ClusterOutput(ruled_surface)
divide_surface = DivideSurface(Surface=ruled_surface, UCount=u_count, VCount=v_count)  # -> flatten(Points), flatten(Normals), flatten(Parameters)
iso_curve = IsoCurve(Surface=ruled_surface, UVPoint=flatten(divide_surface.Parameters))  # -> flatten(UIsocurve), flatten(VIsocurve)
u_isocurve = ClusterOutput(iso_curve.UIsocurve)
v_isocurve = ClusterOutput(iso_curve.VIsocurve)

# ==== cluster Cluster_2
curve = ClusterInput()
length = Length(Curve=curve)
B = ClusterInput()
division = Division(A=length, B=B)
average = Average(Input=division)
integer = Integer(average)
integer_2 = ClusterOutput(integer)
