# Grasshopper definition desgin_zac.ghx (Grasshopper 1.0.7)

image_sampler = ImageSampler(Filter="Colour", Interpolate=False, Umax=1, Umin=0, Vmax=1, Vmin=0, Wrap=1)

# ----
# 1) Load robot from ROS
connect = BooleanToggle(True)
ros = ROSConnect(connect=connect)  # -> ros_client, is_connected; inputs port: Int32, connect: Boolean
#   port ip: The ip address ROS. Defaults to 127.0.0.1.
#   port port: The port of ROS. Defaults to 9090.
#   port connect: If True, connects to ROS. If False, disconnects from ROS. Defaults to False.
#   port ros_client: The ROS client.
#   port is_connected: True if connection established.
# ---------- ros: Python ----------
"""
Connect or disconnect to ROS.

COMPAS FAB v0.27.0
"""
from ghpythonlib.componentbase import executingcomponent as component
from scriptcontext import sticky as st

from compas_fab.backends import RosClient
from compas_fab.ghpython.components import create_id


class ROSConnect(component):
    def RunScript(self, ip, port, connect):
        ros_client = None

        ip = ip or '127.0.0.1'
        port = port or 9090

        key = create_id(self, 'ros_client')
        ros_client = st.get(key, None)

        if ros_client:
            st[key].close()
        if connect:
            st[key] = RosClient(ip, port)
            st[key].run(5)

        ros_client = st.get(key, None)
        is_connected = ros_client.is_connected if ros_client else False
        return (ros_client, is_connected)
# ---------- end ros ----------
load_robot = BooleanToggle(True)
robot = ROSRobot(ros_client=ros.ros_client, load=load_robot)  # -> robot; inputs load: Boolean
#   port ros_client: The ROS client.
#   port load: If True, loads the robot from ROS. Defaults to False.
# ---------- robot: Python ----------
"""
Load robot directly from ROS.

COMPAS FAB v0.27.0
"""
from compas_ghpython.artists import RobotModelArtist
from ghpythonlib.componentbase import executingcomponent as component
from scriptcontext import sticky as st

from compas_fab.ghpython.components import create_id


class ROSRobot(component):
    def RunScript(self, ros_client, load):
        key = create_id(self, 'robot')

        if ros_client and ros_client.is_connected and load:
            # Load URDF from ROS
            st[key] = ros_client.load_robot(load_geometry=True, precision='12f')
            st[key].artist = RobotModelArtist(st[key].model)

        robot = st.get(key, None)
        if robot:  # client sometimes need to be restarted, without needing to reload geometry
            robot.client = ros_client
        return robot
# ---------- end robot ----------
robot_2 = Data(robot)

xsize = Slider(0.008, range=0..0.0999)
unit_x = UnitX(Factor=1)

# ---- group: planners
panel = Panel("AnytimePathShortening")
panel_2 = Panel("LazyPRMstar")
panel_3 = Panel("BiTRRT")
panel_4 = Panel("LIN")
panel_5 = Panel("RRTstar")

# ----
mesh = Mesh(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)
geometry = Geometry(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)
reload = Button()

# ---- group: DESIGN
curve = Curve(<curve referenced from the Rhino model>)
curve_2 = Curve(<curve referenced from the Rhino model>)
curve_3 = Curve(<curve referenced from the Rhino model>)
merge = Merge(Data1=curve, Data2=curve_2, Data3=curve_3)

# ----
geometry_2 = Geometry()

# ---- group: standard configuration
ghpython_script = GhPythonScript()  # -> config
# ---------- ghpython_script: Python ----------
from compas import robots
import math

config = robots. Configuration.from_revolute_values([0,0,0,0,math.pi/2,0])
# ---------- end ghpython_script ----------

# ----
reload_2 = Button()  # disabled
go = Button()

# ----
# 3) Attach tool and robot table
robot_3 = Data(robot_2)
mesh_2 = Mesh(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)
point = Point(Point(0, 0, 0.07307424083))
mesh_3 = Mesh(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)

mesh_join = MeshJoin(Meshes=[mesh_3, mesh, geometry])
construct_plane = ConstructPlane(Origin=point, XAxis=expr("-x", unit_x), YAxis=Vector(0, 1, 0))

attached_tool = AttachedTool(robot=robot_3, visual_mesh=mesh_2, tcf_plane=construct_plane)  # -> robot; inputs visual_mesh: Mesh, collision_mesh: Mesh
#   port visual_mesh: A visual mesh for the tool.
#   port collision_mesh: A collision mesh for the tool.
#   port tcf_plane: The frame of the tool in tool0 frame.
#   port group: The planning group to which the tool should be attached.
# ---------- attached_tool: Python ----------
"""
Attach a tool to the robot.

COMPAS FAB v0.27.0
"""
from ghpythonlib.componentbase import executingcomponent as component
from compas_rhino.conversions import RhinoMesh
from compas_rhino.conversions import plane_to_compas_frame

from compas.geometry import Frame
from compas_fab.robots import Tool


class AttachToolComponent(component):
    def RunScript(self, robot, visual_mesh, collision_mesh, tcf_plane, group):
        if robot and robot.client and robot.client.is_connected and visual_mesh:
            if not collision_mesh:
                collision_mesh = visual_mesh

            c_visual_mesh = RhinoMesh.from_geometry(visual_mesh).to_compas()
            c_collision_mesh = RhinoMesh.from_geometry(collision_mesh).to_compas()

            if not tcf_plane:
                frame = Frame.worldXY()
            else:
                frame = plane_to_compas_frame(tcf_plane)
            tool = Tool(c_visual_mesh, frame, c_collision_mesh)

            robot.attach_tool(tool, group)

        return robot
# ---------- end attached_tool ----------
table = GhPythonScript(robot=robot_3, mesh=mesh_join)  # inputs mesh: Mesh
# ---------- table: Python ----------
from compas_fab.robots import PlanningScene
from compas_fab.robots import CollisionMesh
from compas_rhino.conversions import RhinoMesh

if robot:
    scene = PlanningScene(robot)
    mesh = RhinoMesh.from_geometry(mesh).to_compas()
    cm = CollisionMesh(mesh, "table")
    scene.add_collision_mesh(cm)
# ---------- end table ----------
robot_4 = Data(attached_tool)

# ----
# Robot control
robot_5 = Data(robot_4)
ros_2 = GhPythonScript(robot=robot_5)  # -> ros
# ---------- ros_2: Python ----------
if robot and robot.client:
    ros = robot.client
# ---------- end ros_2 ----------
abb = GhPythonScript(ros_client=ros_2)  # -> abb
# ---------- abb: Python ----------
import compas_rrc as rrc

if ros_client and ros_client.is_connected:
    abb = rrc.AbbClient(ros_client)
# ---------- end abb ----------
speed = Slider(100, range=0..100)
inverse_kinematics = InverseKinematics(robot=robot_4, plane=geometry_2, start_configuration=ghpython_script)  # -> configuration
#   port plane: The plane or frame to calculate the inverse kinematic for.
#   port start_configuration: If passed, calculates the inverse such that the joint positions differ the least from the start_configuration. Defaults to the zero configuration.
#   port group: The planning group used for calculation. Defaults to the robot's main planning group.
#   port configuration: The planning group's configuration.
# ---------- inverse_kinematics: Python ----------
"""
Calculate the robot's inverse kinematic for a given plane.

COMPAS FAB v0.27.0
"""
from compas_rhino.conversions import RhinoPlane
from ghpythonlib.componentbase import executingcomponent as component


class InverseKinematics(component):
    def RunScript(self, robot, plane, start_configuration, group):
        configuration = None
        if robot and robot.client and robot.client.is_connected and plane:
            frame = RhinoPlane.from_geometry(plane).to_compas_frame()
            configuration = robot.inverse_kinematics(frame, start_configuration, group)
        return configuration
# ---------- end inverse_kinematics ----------
go_2 = Button()
ghpython_script_2 = GhPythonScript(robot=robot_4, abb=abb, configuration=ghpython_script, speed=speed, go=go)
# ---------- ghpython_script_2: Python ----------
import compas_rrc as rrc
from compas_fab.robots import to_degrees


# Create Ros Client
ros = rrc.RosClient()
ros.run()



joints = to_degrees(configuration.joint_values)
speed = speed or 500
zone = rrc.Zone.FINE
# Move robot to start position
if go:
    abb.send(rrc.MoveToJoints(joints, ext_axes=[], speed=speed, zone=zone))
# ---------- end ghpython_script_2 ----------

ghpython_script_3 = GhPythonScript(robot=robot_5, abb=abb, go=go_2)  # -> out, config, frame
# ---------- ghpython_script_3: Python ----------
import Grasshopper
import System
import Rhino
import scriptcontext as sc

from ghpythonlib.componentbase import executingcomponent as component

from compas_fab.robots import to_radians
from compas_fab.ghpython.components import create_id

import compas_rrc as rrc

if go:
    joints, _ = abb.send_and_wait(rrc.GetJoints(), timeout=5)
    config = robot.zero_configuration()
    config.joint_values = to_radians(joints)

    if robot and config:
        frame = robot.forward_kinematics(config, options=dict(solver='model'))
# ---------- end ghpython_script_3 ----------

# ----
# 2) Define assembly
xsize_2 = Slider(0.03, range=0.001..0.0999)
ysize = Slider(0.017, range=0.001..0.0999)
zsize = Slider(0.012, range=0.001..0.0999)
xgap = Slider(0.005, range=0..0.005)
zgap = Slider(0, range=0..0.005)
wall_options = GhPythonScript(xsize=xsize_2, ysize=zsize, zsize=ysize, xgap=xsize, zgap=zgap)  # -> options
# ---------- wall_options: Python ----------
import collections

options = collections.namedtuple('Options', [
    'xsize',
    'ysize',
    'zsize',
    'xgap',
    'zgap',
])

options.xsize = xsize
options.ysize = ysize
options.zsize = zsize
options.xgap = xgap
options.zgap = zgap
# ---------- end wall_options ----------
area = Area(Geometry=curve)  # -> Area, Centroid
loft = Loft(Curves=merge, Options={Adjust=False, Closed=False, LoftEnds=0, LoftSimp=0, LoftType=0, Rebuild=10, Refit=0.01})

# ---- group: ZAC-CHANGE
wall = GhPythonScript(surface=loft, options=wall_options, geo_center=area.Centroid)  # -> assembly, parts_geo; inputs surface: Surface, geo_center: Point3d
# ---------- wall: Python ----------
import math

from compas.geometry import Box
from compas.geometry import Frame
from compas.geometry import Vector
from compas.geometry import Polyhedron

from compas.geometry import Translation
from compas.datastructures import Assembly
from compas.datastructures import Part

from compas.utilities import linspace
from compas_rhino.conversions import RhinoSurface

# Default

xsize = options.xsize
ysize = options.ysize
zsize = options.zsize
xgap = options.xgap
zgap = options.zgap

surface = RhinoSurface.from_geometry(surface).to_compas()

parts_geo = []


wall_vertical_curve = surface.v_isocurve(0)

wall_height = wall_vertical_curve.length()
courses = int(math.ceil((wall_height / (zsize + zgap))))

assembly = Assembly()
assembly.attributes['count'] = 0
full_brick = Box.from_diagonal([(-xsize / 2, -ysize / 2, 0), (xsize / 2, ysize / 2, -zsize)])

center_vector = Vector(geo_center.X, geo_center.Y,0)
a = full_brick


for ri, row in enumerate(linspace(0, 1, courses)):
    
    _, u = wall_vertical_curve.rhino_curve.NormalizedLengthParameter(row)
    
    row_curve = surface.u_isocurve(u)
    row_length = row_curve.length()

    c = (row_length / (xsize + xgap))
    col_count = int(math.ceil(c))
    linspaced_vector = list(linspace(0, 1, col_count))
    
    for ci, l in enumerate(linspaced_vector):
        if ci ==0: continue
        fits, col = row_curve.rhino_curve.NormalizedLengthParameter(l)
        if not fits: break

        if ri % 2 == 0 :
            point = row_curve.point_at(col+0.5*(xsize+xgap))
            xaxis = row_curve.tangent_at(col+0.5*(xsize+xgap))
#            point = row_curve.point_at(col)
#            xaxis = row_curve.tangent_at(col)
            frame = Frame(point,xaxis , -xaxis.cross(Vector.Zaxis()))
        else:
            point = row_curve.point_at(col)
            xaxis = row_curve.tangent_at(col)
            frame = Frame(point, xaxis, -xaxis.cross(Vector.Zaxis()))
            
#           !!!!!!!!!!!!!!!!!!!!!!!!!!!!!!!!!!!!!!!!!!!!!!!!!!!!!!!!!!!!!!!!!!!!!!!!!!!!!! 
        if frame.yaxis.dot(center_vector)<0 : frame = Frame(frame.point, -frame.xaxis, -frame.yaxis)
        
        
        frame.transform(Translation.from_vector([0, 0, zsize]))
        
        brick = full_brick.copy()
            
        brick_shape = Polyhedron(*brick.to_vertices_and_faces(triangulated=True))
        part = Part(
            shape=brick_shape,
            frame=frame,
            course=ri,
            n=ci,
            xsize=brick.xsize,
            ysize=brick.ysize,
            zsize=brick.zsize,
        )
        assembly.add_part(part)
        assembly.attributes['count'] = assembly.attributes['count']+1



for part in assembly.parts():
    part.attributes['place_frame'] = part.frame
    
    
parts_geo = [part.geometry for part in assembly.parts()]
# ---------- end wall ----------

# ---- group: Back up
current_part_index = Slider(1, range=0..400)
frames = GhPythonScript(assembly=wall.assembly, current_part_index=current_part_index)  # -> current_part, place_frame, a; inputs current_part_index: Int32
# ---------- frames: Python ----------
from helpers import traverse
from helpers import draw_parts
from helpers import draw_connections
from helpers import draw_parts_attribute
from helpers import get_assembly_sequence
from compas.artists import Artist

a = []
a += draw_parts_attribute(assembly, 'place_frame')

for i in range(current_part_index):
        current_part = assembly.find_by_key(i)
        place_frame = current_part.attributes['place_frame']
# ---------- end frames ----------
geometry_3 = Geometry(frames.a)

# ----
draw = Draw(cg=wall.parts_geo)  # -> rg; disabled
#   port cg: The COMPAS geometry or datastructure to be drawn.
#   port rg: The Rhino geometry object.
# ---------- draw: Python ----------
"""
Draws COMPAS geometry in Grasshopper.
"""
from ghpythonlib.componentbase import executingcomponent as component

from compas.artists import Artist


class CompasToRhinoGeometry(component):
    def RunScript(self, cg):
        if not cg:
            return None

        return Artist(cg).draw()
# ---------- end draw ----------

data = Data(wall.assembly)

# ----
# 4) Define pick-up plane
geometry_4 = Geometry([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])
list_item = ListItem(List=geometry_4, Index=0, Wrap=True)

plane = Plane(list_item)

pickup_plane = Data(plane)

ghpython_script_4 = GhPythonScript(
    robot=robot_4,
    visual_mesh=mesh_2,
    tcf_plane=construct_plane,
    assembly=data,
    pick_frame=pickup_plane,
    approach_distance="0.1",
    planner_id=panel_3,
    reload=reload)  # -> dir; inputs visual_mesh: Mesh
# ---------- ghpython_script_4: Python ----------
import compas
import os
from compas_rhino.conversions import RhinoPlane,RhinoMesh,plane_to_compas_frame


path = ghenv.Component.OnPingDocument().FilePath
dir = os.path.join(os.path.dirname(path), "data.json")

pick_frame = RhinoPlane.from_geometry(pick_frame).to_compas_frame()
c_visual_mesh = RhinoMesh.from_geometry(visual_mesh).to_compas()
tcf_frame = plane_to_compas_frame(tcf_plane)

data = {"group": group, "c_visual_mesh":c_visual_mesh,"tcf_frame":tcf_frame, "assembly": assembly, "pick_frame": pick_frame, "approach_distance": approach_distance, "planner_id": planner_id}

print data
compas.json_dump(data, dir,True)
# ---------- end ghpython_script_4 ----------
let_vscode_do = Panel(ghpython_script_4)
ghpython_script_5 = GhPythonScript(print=let_vscode_do, reload=reload_2)  # -> all_trajectories; disabled
# ---------- ghpython_script_5: Python ----------
import compas
import os
from compas_rhino.conversions import RhinoPlane


path = ghenv.Component.OnPingDocument().FilePath
dir = os.path.join(os.path.dirname(path), "trajectories.json")


all_trajectories = compas.json_load(dir)
# ---------- end ghpython_script_5 ----------
ghpython_script_6 = GhPythonScript(x=ghpython_script_5)  # -> a; inputs x: list
# ---------- ghpython_script_6: Python ----------
a = []
for i in range(int(len(x)/6)):
    a.append(x[int(i*6+2)])
# ---------- end ghpython_script_6 ----------
list_item_2 = ListItem(List=ghpython_script_6, Index=Slider(19, range=0..100), Wrap=True)
trajectory_visualize = TrajectoryVisualize(robot=robot_4, trajectory=ghpython_script_5)  # -> start_configuration, configurations, fraction, time, planes, P, V, A
#   port group: The planning group for which this trajectory was planned.
#   port trajectory: The calculated trajectory.
#   port start_configuration: The start configuration of the trajectory.
#   port configurations: The full configurations along the trajectory.
#   port fraction: Indicates the fraction of requested trajectory that was calculated, e.g. 1 means the full trajectory was found.
#   port time: The time which is needed to execute that trajectory at full speed.
#   port planes: The planes of the robot's end-effector.
#   port P: The positions along the trajectory
#   port V: The velocities along the trajectory
#   port A: The accelerations along the trajectory
# ---------- trajectory_visualize: Python ----------
"""
Visualizes a trajectory.

COMPAS FAB v0.27.0
"""
from compas_ghpython import draw_frame
from compas_ghpython import list_to_ghtree
from ghpythonlib.componentbase import executingcomponent as component


class TrajectoryVisualize(component):
    def RunScript(self, robot, group, trajectory):
        start_configuration = None
        configurations = []
        fraction = 0.
        time = 0.

        planes = []
        positions = []
        velocities = []
        accelerations = []

        if robot and trajectory:
            group = group or robot.main_group_name

            for c in trajectory.points:
                configurations.append(robot.merge_group_with_full_configuration(c, trajectory.start_configuration, group))
                frame = robot.forward_kinematics(c, group, options=dict(solver='model'))
                planes.append(draw_frame(frame))
                positions.append(c.positions)
                velocities.append(c.velocities)
                accelerations.append(c.accelerations)

            start_configuration = trajectory.start_configuration
            fraction = trajectory.fraction
            time = trajectory.time_from_start

        P = list_to_ghtree(list(zip(*positions)))
        V = list_to_ghtree(list(zip(*velocities)))
        A = list_to_ghtree(list(zip(*accelerations)))

        # return outputs if you have them; here I try it for you:
        return (start_configuration, configurations, fraction, time, planes, P, V, A)
# ---------- end trajectory_visualize ----------
