# Grasshopper definition my_own_function.gh (Grasshopper 1.0.7)
# plug-ins: Fologram For Grasshopper Utilities, FologramForGrasshopper

data_folder_name = Panel("data")

# ----
# Output
# Input
py = PythonScript()  # -> path
# ---------- py: Python ----------
import sys
import os

ghComp = ghenv.Component
ghDoc = ghComp.OnPingDocument()

# the full path of the gh file
path = ghDoc.FilePath
# the current directory 
path = os.path.abspath(os.path.join(path, ".."))

print path
# ---------- end py ----------

# ---- group: Folder name
data = Data(data_folder_name)

# ---- group: Path cross-section
# Visualization
xz = XZPlane(Origin=Point(0, 0, 0))
rectangle = Rectangle(Plane=xz, XSize=Slider(2.5, range=0..10), YSize=Slider(1, range=0..10), Radius=Slider(0.43, range=0..1))  # -> Rectangle, Length

# ----
# Load Printpoints
panel = Panel("out_printpoints.json")
csloadprintpoints = CsLoadPrintpoints(recompute=Button(), json_name=panel, path=py, folder_name=data)  # -> out, geometry, points, frames, layer_heights, up_vectors, mesh_normals, closest_support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; inputs recompute: Boolean
# ---------- csloadprintpoints: Python ----------
"""
Loads a dictionaly of Printpoints from a json file in the 'output' folder.

"""

import compas_slicer_ghpython.visualization as gh_compas_slicer
gh_compas_slicer = reload(gh_compas_slicer)


if path and folder_name and json_name:
    points, frames, layer_heights, up_vectors, mesh_normals, closest_support, velocities, wait_times, \
    blend_radiuses, extruder_toggles = \
        gh_compas_slicer.load_printpoints(path, folder_name, json_name)
    
else:
    gh_compas_slicer.missing_input()
# ---------- end csloadprintpoints ----------

# ----
# Load Slicer
panel_2 = Panel("slicer_data.json")
# In order for the components in this file to work, you need to add the correct folder to your paths in Rhino.
# In Rhino, type "EditPythonScript", go to Tools > Options > Add to search path and add the following folder:
# <path>/compas_slicer/src/grasshopper_visualization'
button = Button()
csloadslicer = CsLoadSlicer(recompute=button, json_name=panel_2, path=py, folder_name=data)  # -> out, mesh, paths, are_closed, all_points; inputs recompute: Boolean
# ---------- csloadslicer: Python ----------
"""
Loads a Slicer class from its json file in the 'output' folder.

"""

import compas_slicer_ghpython.visualization as gh_compas_slicer
gh_compas_slicer = reload(gh_compas_slicer)


if path and folder_name and json_name:
    mesh, paths, are_closed, all_points = gh_compas_slicer.load_slicer(path, folder_name, json_name)
    
else:
    gh_compas_slicer.missing_input()
# ---------- end csloadslicer ----------

paths = Curve(csloadslicer.paths)
all_points = Point(csloadslicer.all_points)
mesh = Mesh(csloadslicer.mesh)

mpipe = MeshPipe(Polylines=paths, NumberOfSides=4, Tolerance=0.1, Radius=1, Cap=False, Join=False)
panel_3 = Panel(csloadprintpoints.out)

mesh_normals = Vector(csloadprintpoints.mesh_normals)
layer_heights = Number(csloadprintpoints.layer_heights)
up_vectors = Vector(csloadprintpoints.up_vectors)
frames = Plane(csloadprintpoints.frames)
points = Point(csloadprintpoints.points)
cpts = Point(csloadprintpoints.closest_support)

mesh_normals_2 = Vector(mesh_normals)
points_2 = Point(points)
section = Curve(rectangle.Rectangle)

extruder_toggles = Number(csloadprintpoints.extruder_toggles)
velocities = Number(csloadprintpoints.velocities)
wait_times = Number(csloadprintpoints.wait_times)
blend_radiuses = Number(csloadprintpoints.blend_radiuses)

# ----
# Ligthweight Path Visualization
number_slider = Slider(2, range=0..10)
extruder_toggles_2 = Number(extruder_toggles)
all_points_2 = Point(points)
cslightpathviz = CsLightPathViz(points=all_points_2, extruder_toggles=extruder_toggles_2, pipe_diameter=number_slider)  # -> out, print_path_pipes, travel_path_lines; inputs points: list of Point3d, extruder_toggles: list of Boolean
# ---------- cslightpathviz: Python ----------
"""
Creates a lightweight visualization of the print paths. Segments with extruder_toggle=True are visualized as pipes, 
segments with extruder_toggle=False are visualized as lines.
Loads files from the 'output' folder.

"""

import compas_slicer_ghpython.visualization as gh_compas_slicer
gh_compas_slicer = reload(gh_compas_slicer)

pipe_resolution = 14

if points:
    
    # assign default values to parameters where possible. 
    if not extruder_toggles:
        extruder_toggles = [False for i in range(len(points))]
    if not pipe_diameter:
        pipe_diameter = 2.0
        
    print_path_pipes, travel_path_lines = \
        gh_compas_slicer.lightweight_path_visualization(points, extruder_toggles, pipe_diameter, pipe_resolution)
    
else:
    gh_compas_slicer.missing_input()
# ---------- end cslightpathviz ----------

# ----
# Render Path Visualization
extruder_toggles_3 = Number(extruder_toggles)
layer_heights_2 = Number(layer_heights)
up_vectors_2 = Vector(up_vectors)
python = CsRenderPathViz(
    points=points_2,
    mesh_normals=mesh_normals_2,
    layer_heights=layer_heights_2,
    up_vectors=up_vectors_2,
    extruder_toggles=extruder_toggles_3,
    cross_section=section,
    planar_printing=Toggle(True),
    compute=Toggle(False))  # -> out, loft_surfaces, travel_path_lines; inputs points: list of Point3d, mesh_normals: list of Vector3d, layer_heights: list, up_vectors: list of Vector3d, extruder_toggles: list of Boolean, cross_section: Curve, planar_printing: Boolean, compute: Boolean
# ---------- python: Python ----------
"""
Creates a render visualization of the print paths with loft surfaces where extruder_toggle=True.
For large number of points, this can take a while to compute, so keep it turned off unless you need it.
Loads files from the 'output' folder.

"""

import compas_slicer_ghpython.visualization as gh_compas_slicer
gh_compas_slicer = reload(gh_compas_slicer)

pipe_resolution = 14

if points and mesh_normals and layer_heights and extruder_toggles and cross_section:
    if compute:
        loft_surfaces, travel_path_lines = \
            gh_compas_slicer.render_path_visualization(points, mesh_normals, layer_heights, up_vectors, extruder_toggles, cross_section, planar_printing)
    else:
        print('Compute is set to False')
else:
    gh_compas_slicer.missing_input()
# ---------- end python ----------

sync = SyncObject(
    GM=mpipe,
    AlwaysIncludeTextureCoordinates=False,
    Clickable=False,
    DefaultCurveThicknessMillimeters=2.5,
    DefaultGlossPercent=0,
    DefaultMaterialColor=RGB(255, 255, 255),
    DefaultSpecularPercent=0,
    Grabbable=False,
    Interactive=False,
    Occlusion=False,
    Outline=False,
    hasSerializedData=True)

# ---- group: Polyline toolpath
dom = ConstructDomain(DomainStart=0, DomainEnd=1)
subset = SubList(List=points, Domain=dom, Wrap=True)  # -> List, Index
pline = PolyLine(Vertices=subset.List, Closed=False)

# ---- group: Color output
geo = Geometry(cslightpathviz.travel_path_lines)
geo_2 = Geometry(cslightpathviz.print_path_pipes)
preview = CustomPreview(Geometry=geo_2, Material=ColourSwatch(SwatchColor=RGB(199, 199, 199)))
preview_2 = CustomPreview(Geometry=geo, Material=ColourSwatch(SwatchColor=RGB(255, 156, 36)))

geo_3 = Geometry(python.loft_surfaces)
geo_4 = Geometry(python.travel_path_lines)
preview_3 = CustomPreview(Geometry=geo_3, Material=ColourSwatch(SwatchColor=RGB(222, 222, 222)))
preview_4 = CustomPreview(Geometry=geo_4, Material=ColourSwatch(SwatchColor=RGB(255, 156, 36)))

# ----
vdis = VectorDisplay(Anchor=points, Vector=expr("x*5", up_vectors))
pline_2 = PolyLine(Vertices=points, Closed=False)

# ---- group: Select parameter to display
list = ValueList({"Velocity": 0, "Wait time": 1, "Blend radius": 2, "Extruder Toggle": 3}, selected="Blend radius")

# ----
filter = StreamFilter(Gate=list, Stream0=velocities, Stream1=wait_times, Stream2=blend_radiuses, Stream3=extruder_toggles)
num = Number(filter)

# ---- group: Visualize parameter with text
tag_offset = Slider(1, range=0..100)
pdecon = Deconstruct(Point=points)  # -> XComponent, YComponent, ZComponent
addition = Addition(A=pdecon.ZComponent, B=tag_offset)
pt = ConstructPoint(XCoordinate=pdecon.XComponent, YCoordinate=pdecon.YComponent, ZCoordinate=addition)
tag = TextTag(Location=pt, Text=num, Colour=ColourSwatch(SwatchColor=RGB(50, 130, 186)))

# ---- group: Visualize parameter with color
bnd = Bounds(Numbers=num)
avr = Average(Input=num)
dedomain = DeconstructDomain(Domain=bnd)  # -> Start, End
average = Panel(avr)
gradient = Gradient(
    LowerLimit=dedomain.Start,
    UpperLimit=dedomain.End,
    Parameter=num,
    stops=[0: RGB(0, 128, 0), 0.5: RGB(255, 255, 0), 1: RGB(255, 0, 0)])
pt_2 = Point(points)
cloud = CloudDisplay(Points=pt_2, Colours=gradient, Size=Slider(3.96, range=0..10), SpriteType=0)

# ---- group: Slicer data
len = Length(Curve=flatten(paths))
lng = ListLength(List=flatten(paths))
ma = MassAddition(Input=len)  # -> Result, PartialResults
total_path_length = Panel(ma.Result)
total_number_of_paths = Panel(lng)

# ----
min = Panel(dedomain.Start)
max = Panel(dedomain.End)
